# Grasshopper definition 230920_FT20_OptimizationExamples.gh (Grasshopper 1.0.7)
# plug-ins: Hops

select_demo_structure = ValueList({"Structure A": 0, "Structure B": 1}, selected="Structure B")

pipeline = GeometryPipeline(
    GroupByLayer=False,
    GroupByType=False,
    IncludeHidden=True,
    IncludeLocked=True,
    LayerFilter="STRUCTURE_B",
    NameFilter="*",
    SublayerFiltering=True,
    TypeFilter=1073741848)
pipeline_2 = GeometryPipeline(
    GroupByLayer=False,
    GroupByType=False,
    IncludeHidden=True,
    IncludeLocked=True,
    LayerFilter="STRUCTURE_A",
    NameFilter="*",
    SublayerFiltering=True,
    TypeFilter=1073741848)
entwine = Entwine(Branch00=pipeline_2, Branch01=pipeline, FlattenInputs=True)
bbox = BoundingBox(Content=flatten(entwine), Plane=PlaneXY(0, 0, 0), UnionBox=True)  # -> Box, Box_2
bbox_2 = BoundingBox(Content=entwine, Plane=PlaneXY(0, 0, 0), UnionBox=True)  # -> Box, Box_2
volume = Volume(Geometry=bbox_2.Box)  # -> Volume, Centroid
xy = XYPlane(Origin=Point(0, 0, 0))
volume_2 = Volume(Geometry=bbox.Box)  # -> Volume, Centroid
project = Project(Geometry=volume.Centroid, Plane=xy)  # -> Geometry, Transform
project_2 = Project(Geometry=volume_2.Centroid, Plane=xy)  # -> Geometry, Transform
vec2pt = Vector2Pt(PointA=project.Geometry, PointB=project_2.Geometry, Unitize=False)  # -> Vector, Length
move = Move(Geometry=entwine, Motion=vec2pt.Vector)  # -> Geometry, Transform
tstat = TreeStatistics(Tree=move.Geometry)  # -> Paths, Length, Count
item = ListItem(List=tstat.Paths, Index=select_demo_structure, Wrap=True)
branch = TreeBranch(Tree=move.Geometry, Path=item, MaintainPaths=True)

renderdemandmodel = BooleanToggle(False)
filter = StreamFilter(Gate=renderdemandmodel, Stream1=branch)
edges = BrepEdges(Brep=filter)  # -> Naked, Interior, NonManifold
comments_notes = Panel("demand model visualisation")
cpl = CustomPreviewLineweights(Geometry=flatten([edges.Naked, edges.Interior, edges.NonManifold]), Color=ColourSwatch(SwatchColor=RGB(0, 0, 0)))  # inputs Geometry: list, Color: Color
# ---------- cpl: Python ----------
"""
Custom Preview with Lineweights.
    Inputs:
        Geometry: The geometry to preview. {list, GeometryBase}
        Color: The preview color. {item, System.Drawing.Color}
        Thickness: The thickness of the wire display. {item, int}
    Remarks:
        Author: Max Eschenbach
        License: MIT License
        Version: 230106
"""

# PYTHON STANDARD LIBRARY IMPORTS
from __future__ import division, print_function
import json
import math

# GHPYTHON SDK IMPORTS
from ghpythonlib.componentbase import executingcomponent as component
import Grasshopper, GhPython
import System
import Rhino
import rhinoscriptsyntax as rs

# GHENV COMPONENT SETTINGS
ghenv.Component.Name = "CustomPreviewLineweights"
ghenv.Component.NickName = "CPL"
ghenv.Component.Category = "FindersKeepers"
ghenv.Component.SubCategory = "4 Visualisation"

class CustomPreviewLineweights(component):
    
    def __init__(self):
        super(CustomPreviewLineweights, self).__init__()
        
        self.draw_lines = System.Collections.Generic.List[Rhino.Geometry.Line]()
        self.draw_curves = []
        self.draw_color = None
        self.draw_thickness = None
    
    
    def RunScript(self, Geometry, Color, Thickness):
        
        self.draw_lines = System.Collections.Generic.List[Rhino.Geometry.Line]()
        self.draw_curves = []
        self.draw_color = None
        self.draw_thickness = None
        
        if not Color:
            self.draw_color = System.Drawing.Color.Black
        else:
            self.draw_color = Color
        
        if not Thickness:
            self.draw_thickness = 1
        else:
            self.draw_thickness = Thickness
        
        if Geometry:
            for i, geo in enumerate(Geometry):
                if isinstance(geo, Rhino.Geometry.Line):
                    self.draw_lines.Add(geo)
                elif isinstance(geo, Rhino.Geometry.Curve):
                    self.draw_curves.append(geo)
                elif isinstance(geo, Rhino.Geometry.LineCurve):
                    self.draw_lines.Add(geo.Line)
                elif isinstance(geo, Rhino.Geometry.Rectangle3d):
                    self.draw_curves.append(geo.ToNurbsCurve())
                else:
                    print(type(geo))
    
    
    def get_ClippingBox(self):
        return Rhino.Geometry.BoundingBox()
    
    
    def DrawViewportWires(self, arg):
        try:
            arg.Display.DrawLines(self.draw_lines, self.draw_color, self.draw_thickness)
            for crv in self.draw_curves:
                arg.Display.DrawCurve(crv, self.draw_color, self.draw_thickness)
        except Exception, e:
            System.Windows.Forms.MessageBox.Show(
                                str(e),
                                'Error while drawing preview!')
# ---------- end cpl ----------
preview = CustomPreview(Geometry=filter, Material=ColourSwatch(SwatchColor=RGB(255, 255, 255)))

# ----
# EXPERIMENTAL SLICER SETUP FOR CLAY PRINTING: Author: Max Benjamin Eschenbach
# 
# Digital Design Unit (DDU)
# Prof. Dr.-Ing. Oliver Tessmann
# Fachbereich Architektur
# Technical University of Darmstadt
# 
# 
# CREDITS:
# ------------------------
# 
# Public Funding
# ------------------------
# This research was conducted within the Project Fertigteil 2.0 - Real-digital process chains for the production of built-in concrete components. The project Fertigteil 2.0 (Precast Concrete Components 2.0) was funded by the Federal Ministry of Education and Research Germany (BMBF) through the funding measure Resource-efficient circular economy - Building and mineral cycles (ReMin).
# 
# 
# Licensing & References
# ------------------------
# Original code is licensed under the MIT License.
# comments & notes: DEFINE DUMMY COLUMN REPOSITORY
repository_amount = Slider(400, range=1..2000)
jitterseed = Slider(374443, range=0..1000000)
randreduceseed = Slider(716689, range=0..1000000)
jitterseed_2 = Slider(317960, range=0..1000000)
randreduceseed_2 = Slider(707676, range=0..1000000)
repository_amount_2 = Integer(repository_amount)
stock_csx = Panel("0.3")
stock_csx_2 = Panel("0.4")
stock_csx_3 = Panel("0.4")
stock_csy = Panel("0.3")
stock_csy_2 = Panel("0.4")
stock_csy_3 = Panel("0.3")
stock_csx_4 = Panel("0.5")
stock_csy_4 = Panel("0.5")
stock_csx_5 = Panel("0.5")
stock_csy_5 = Panel("0.4")
stock_csx_6 = Panel("0.5")
stock_csy_6 = Panel("0.3")
stock_csx_7 = Panel("0.6")
stock_csy_7 = Panel("0.6")
stock_csx_8 = Panel("0.6")
stock_csy_8 = Panel("0.5")
stock_csx_9 = Panel("0.6")
stock_csy_9 = Panel("0.4")
stock_csx_10 = Panel("0.6")
stock_csy_10 = Panel("0.3")
stock_length = Panel("""3.0
3.1
3.2
3.3
3.4
3.5
3.6
3.7
3.8
3.9
4.0
4.1
4.2
4.3
4.4
4.5
4.6
4.7
4.8
4.9
5.0
5.1
5.2""")
pt = ConstructPoint(XCoordinate=0, YCoordinate=stock_csx, ZCoordinate=stock_csy)
pt_2 = ConstructPoint(XCoordinate=0, YCoordinate=stock_csx_2, ZCoordinate=stock_csy_2)
pt_3 = ConstructPoint(XCoordinate=0, YCoordinate=stock_csx_3, ZCoordinate=stock_csy_3)
pt_4 = ConstructPoint(XCoordinate=0, YCoordinate=stock_csx_4, ZCoordinate=stock_csy_4)
pt_5 = ConstructPoint(XCoordinate=0, YCoordinate=stock_csx_5, ZCoordinate=stock_csy_5)
pt_6 = ConstructPoint(XCoordinate=0, YCoordinate=stock_csx_6, ZCoordinate=stock_csy_6)
pt_7 = ConstructPoint(XCoordinate=0, YCoordinate=stock_csx_7, ZCoordinate=stock_csy_7)
pt_8 = ConstructPoint(XCoordinate=0, YCoordinate=stock_csx_8, ZCoordinate=stock_csy_8)
pt_9 = ConstructPoint(XCoordinate=0, YCoordinate=stock_csx_9, ZCoordinate=stock_csy_9)
pt_10 = ConstructPoint(XCoordinate=0, YCoordinate=stock_csx_10, ZCoordinate=stock_csy_10)
repeat = RepeatData(Data=stock_length, Length=expr("x*3", repository_amount))
repeat_2 = RepeatData(Data=pt_10, Length=repository_amount_2)
repeat_3 = RepeatData(Data=pt_7, Length=repository_amount_2)
repeat_4 = RepeatData(Data=pt_8, Length=repository_amount_2)
repeat_5 = RepeatData(Data=pt_6, Length=repository_amount_2)
repeat_6 = RepeatData(Data=pt_9, Length=repository_amount_2)
repeat_7 = RepeatData(Data=pt_5, Length=repository_amount_2)
repeat_8 = RepeatData(Data=pt_4, Length=repository_amount_2)
repeat_9 = RepeatData(Data=pt, Length=repository_amount_2)
repeat_10 = RepeatData(Data=pt_2, Length=repository_amount_2)
repeat_11 = RepeatData(Data=pt_3, Length=repository_amount_2)
jitter = Jitter(List=repeat, Jitter=1, Seed=jitterseed)  # -> Values, Indices
reduce = RandomReduce(List=jitter.Values, Reduction=expr("x*2", repository_amount), Seed=randreduceseed)
merge = Merge(
    Data1=repeat_9,
    Data2=repeat_10,
    Data3=repeat_11,
    Data4=repeat_8,
    Data5=repeat_7,
    Data6=repeat_5,
    Data7=repeat_3,
    Data8=repeat_4,
    Data9=repeat_6,
    Data10=repeat_2)
jitter_2 = Jitter(List=merge, Jitter=1, Seed=jitterseed_2)  # -> Values, Indices
lng = ListLength(List=jitter_2.Values)
subtraction = Subtraction(A=lng, B=repository_amount_2)
reduce_2 = RandomReduce(List=jitter_2.Values, Reduction=subtraction, Seed=randreduceseed_2)
pdecon = Deconstruct(Point=reduce_2)  # -> XComponent, YComponent, ZComponent
python = GhPythonScript(CSX=pdecon.YComponent, CSY=pdecon.ZComponent)  # -> CS_L, CS_S
# ---------- python: Python ----------
__author__ = "EFESTWIN"
__version__ = "2022.09.09"

if CSX >= CSY:
    CS_L = CSX
    CS_S = CSY
else:
    CS_L = CSY
    CS_S = CSX
# ---------- end python ----------
repo_column_len = Number(reduce)
repo_column_csx = Number(python.CS_L)
repo_column_csy = Number(python.CS_S)

# ----
# comments & notes: DEFINE DUMMY BEAM REPOSITORY
jitterseed_3 = Slider(277582, range=0..1000000)
randreduceseed_3 = Slider(886689, range=0..1000000)
jitterseed_4 = Slider(144239, range=0..1000000)
randreduceseed_4 = Slider(687364, range=0..1000000)
repository_amount_3 = Integer(repository_amount)
repository_amount_4 = Integer(repository_amount_3)
stock_csx_11 = Panel("0.53")
stock_csy_11 = Panel("0.52")
stock_csx_12 = Panel("0.53")
stock_csy_12 = Panel("0.53")
stock_csx_13 = Panel("0.52")
stock_csy_13 = Panel("0.52")
stock_csx_14 = Panel("0.3")
stock_csx_15 = Panel("0.4")
stock_csx_16 = Panel("0.4")
stock_csy_14 = Panel("0.3")
stock_csy_15 = Panel("0.4")
stock_csy_16 = Panel("0.3")
stock_csx_17 = Panel("0.5")
stock_csy_17 = Panel("0.5")
stock_csx_18 = Panel("0.5")
stock_csx_19 = Panel("0.5")
stock_csx_20 = Panel("0.6")
stock_csy_18 = Panel("0.4")
stock_csy_19 = Panel("0.3")
stock_csy_20 = Panel("0.6")
stock_csx_21 = Panel("0.6")
stock_csy_21 = Panel("0.5")
stock_csx_22 = Panel("0.6")
stock_csy_22 = Panel("0.4")
stock_csx_23 = Panel("0.6")
stock_csy_23 = Panel("0.3")
stock_length_2 = Panel("""4.0
4.25
4.5
4.75
5.0
5.25
5.5
5.75
6.0
6.25
6.5
6.75
7.0
7.25
7.5
7.75
8.0
8.25
8.5""")
pt_11 = ConstructPoint(XCoordinate=0, YCoordinate=stock_csx_11, ZCoordinate=stock_csy_11)
pt_12 = ConstructPoint(XCoordinate=0, YCoordinate=stock_csx_12, ZCoordinate=stock_csy_12)
pt_13 = ConstructPoint(XCoordinate=0, YCoordinate=stock_csx_13, ZCoordinate=stock_csy_13)
pt_14 = ConstructPoint(XCoordinate=0, YCoordinate=stock_csx_14, ZCoordinate=stock_csy_14)
pt_15 = ConstructPoint(XCoordinate=0, YCoordinate=stock_csx_15, ZCoordinate=stock_csy_15)
pt_16 = ConstructPoint(XCoordinate=0, YCoordinate=stock_csx_16, ZCoordinate=stock_csy_16)
pt_17 = ConstructPoint(XCoordinate=0, YCoordinate=stock_csx_17, ZCoordinate=stock_csy_17)
pt_18 = ConstructPoint(XCoordinate=0, YCoordinate=stock_csx_18, ZCoordinate=stock_csy_18)
pt_19 = ConstructPoint(XCoordinate=0, YCoordinate=stock_csx_19, ZCoordinate=stock_csy_19)
pt_20 = ConstructPoint(XCoordinate=0, YCoordinate=stock_csx_20, ZCoordinate=stock_csy_20)
pt_21 = ConstructPoint(XCoordinate=0, YCoordinate=stock_csx_21, ZCoordinate=stock_csy_21)
pt_22 = ConstructPoint(XCoordinate=0, YCoordinate=stock_csx_22, ZCoordinate=stock_csy_22)
pt_23 = ConstructPoint(XCoordinate=0, YCoordinate=stock_csx_23, ZCoordinate=stock_csy_23)
repeat_12 = RepeatData(Data=stock_length_2, Length=expr("x*3", repository_amount_3))
repeat_13 = RepeatData(Data=pt_11, Length=repository_amount_4)
repeat_14 = RepeatData(Data=pt_23, Length=repository_amount_4)
repeat_15 = RepeatData(Data=pt_12, Length=repository_amount_4)
repeat_16 = RepeatData(Data=pt_20, Length=repository_amount_4)
repeat_17 = RepeatData(Data=pt_13, Length=repository_amount_4)
repeat_18 = RepeatData(Data=pt_21, Length=repository_amount_4)
repeat_19 = RepeatData(Data=pt_19, Length=repository_amount_4)
repeat_20 = RepeatData(Data=pt_22, Length=repository_amount_4)
repeat_21 = RepeatData(Data=pt_18, Length=repository_amount_4)
repeat_22 = RepeatData(Data=pt_17, Length=repository_amount_4)
repeat_23 = RepeatData(Data=pt_14, Length=repository_amount_4)
repeat_24 = RepeatData(Data=pt_15, Length=repository_amount_4)
repeat_25 = RepeatData(Data=pt_16, Length=repository_amount_4)
jitter_3 = Jitter(List=repeat_12, Jitter=1, Seed=jitterseed_3)  # -> Values, Indices
reduce_3 = RandomReduce(List=jitter_3.Values, Reduction=expr("x*2", repository_amount_3), Seed=randreduceseed_3)
merge_2 = Merge(
    Data1=repeat_23,
    Data2=repeat_24,
    Data3=repeat_25,
    Data4=repeat_22,
    Data5=repeat_15,
    Data6=repeat_13,
    Data7=repeat_17,
    Data8=repeat_21,
    Data9=repeat_19,
    Data10=repeat_16,
    Data11=repeat_18,
    Data12=repeat_20,
    Data13=repeat_14)
jitter_4 = Jitter(List=merge_2, Jitter=1, Seed=jitterseed_4)  # -> Values, Indices
lng_2 = ListLength(List=jitter_4.Values)
subtraction_2 = Subtraction(A=lng_2, B=repository_amount_4)
reduce_4 = RandomReduce(List=jitter_4.Values, Reduction=subtraction_2, Seed=randreduceseed_4)
pdecon_2 = Deconstruct(Point=reduce_4)  # -> XComponent, YComponent, ZComponent
python_2 = GhPythonScript(CSX=pdecon_2.YComponent, CSY=pdecon_2.ZComponent)  # -> CS_L, CS_S; same code as python
repo_beam_len = Number(reduce_3)
repo_beam_csx = Number(python_2.CS_L)
repo_beam_csy = Number(python_2.CS_S)

braunschweig_chemie = Panel("52.277019")
tu_darmstadt = Panel("49.863323")
braunschweig_dbfl = Panel("52.284726")
breuninger_parkhaus_stuttgart = Panel("48.774089348999")
transport_type = Panel("Schwertransport")
pt_24 = ConstructPoint(XCoordinate=braunschweig_chemie, YCoordinate="10.541036", ZCoordinate=0)
pt_25 = ConstructPoint(XCoordinate=tu_darmstadt, YCoordinate="8.678350", ZCoordinate=0)
pt_26 = ConstructPoint(XCoordinate=braunschweig_dbfl, YCoordinate="10.548717", ZCoordinate=0)
pt_27 = ConstructPoint(XCoordinate=breuninger_parkhaus_stuttgart, YCoordinate="9.181329759052195", ZCoordinate=0)
merge_3 = Merge(Data1=pt_25, Data2=pt_26)
merge_4 = Merge(Data1=pt_27, Data2=pt_26)
merge_5 = Merge(Data1=pt_24, Data2=pt_26)
createtransporthistory = CreateTransportHistory(Locations=merge_5, TransportType=transport_type)  # -> TransportHistory; inputs Locations: list of Point3d, TransportType: list
# ---------- createtransporthistory: Python ----------
"""
Compiles transport history based on input locations and transport type.
    Inputs:
        Locations: The locations for the transport history. [list, Point3d}
        TransportType: The transport type used for this transport. {list, str}
    Output:
        TransportHistory: The compiled transport history. {item, str}
    Remarks:
        Author: Max Eschenbach
        License: MIT License
        Version: 230105
"""

# PYTHON STANDARD LIBRARY IMPORTS
from __future__ import division, print_function
from itertools import tee
import json

# GHPYTHON SDK IMPORTS
from ghpythonlib.componentbase import executingcomponent as component
import Grasshopper, GhPython
import System
import Rhino
import rhinoscriptsyntax as rs

# GHENV COMPONENT SETTINGS
ghenv.Component.Name = "CreateTransportHistory"
ghenv.Component.NickName = "CreateTransportHistory"
ghenv.Component.Category = "FERTIGTEIL2.0"
ghenv.Component.SubCategory = "02 Datamodel"

def pairwise(iterable):
            a, b = tee(iterable)
            next(b, None)
            return zip(a, b)

class CreateTransportHistory(component):
    
    def RunScript(self, Locations, TransportType):
        
        TransportHistory = []
        for i, (loc_a, loc_b) in enumerate(pairwise(Locations)):
            if i < len(TransportType):
                ttype = TransportType[i]
            else:
                ttype = TransportType[-1]
            transport = [str(loc_a[0]) + ", " + str(loc_a[1]),
                         str(loc_b[0]) + ", " + str(loc_b[1]),
                         str(-1),
                         ttype]
            TransportHistory.append(transport)
        
        # return outputs if you have them; here I try it for you:
        return json.dumps(TransportHistory)
# ---------- end createtransporthistory ----------
createtransporthistory_2 = CreateTransportHistory(Locations=merge_3, TransportType=transport_type)  # -> TransportHistory; inputs Locations: list of Point3d, TransportType: list; same code as createtransporthistory
createtransporthistory_3 = CreateTransportHistory(Locations=merge_4, TransportType=transport_type)  # -> TransportHistory; inputs Locations: list of Point3d, TransportType: list; same code as createtransporthistory
panel = Panel(createtransporthistory_2)
panel_2 = Panel(createtransporthistory_3)
panel_3 = Panel(createtransporthistory)
transporthistory_chemiegeb = Data(createtransporthistory)
transporthistory_tudacampus = Data(createtransporthistory_2)
transporthistory_bpstuttgart = Data(createtransporthistory_3)

# ----
# comments & notes: randomize assignment of transport history
transporthistory_tudacampus_2 = Data(transporthistory_tudacampus)
transporthistory_bpstuttgart_2 = Data(transporthistory_bpstuttgart)
transporthistory_chemiegeb_2 = Data(transporthistory_chemiegeb)
jitterseed_5 = Slider(180469, range=0..1000000)
repository_amount_5 = Integer(repository_amount)
repo_column_len_2 = Number(repo_column_len)
repo_column_csx_2 = Number(repo_column_csx)
repo_column_csy_2 = Number(repo_column_csy)
braunschweig_dbfl_2 = Panel("52.284726")
material = Panel("1.4.01 (Beton 30/37)")
pointcloud = Panel("")
ifcobject = Panel("")
merge_6 = Merge(Data1=transporthistory_chemiegeb_2, Data2=transporthistory_tudacampus_2, Data3=transporthistory_bpstuttgart_2)
date = Panel("")
pt_28 = ConstructPoint(XCoordinate=repo_column_len_2, YCoordinate=repo_column_csx_2, ZCoordinate=repo_column_csy_2)
pt_29 = ConstructPoint(XCoordinate=braunschweig_dbfl_2, YCoordinate="10.548717", ZCoordinate=0)
type = Panel("Column")
repeat_26 = RepeatData(Data=merge_6, Length=repository_amount_5)
jitter_5 = Jitter(List=repeat_26, Jitter=1, Seed=jitterseed_5)  # -> Values, Indices
comments_notes_2 = Panel("""COMPONENT REPOSITORY
COLUMNS GENERATED""")
createrepositorycomponent = CreateRepositoryComponent(
    Type=type,
    Availability=Toggle(True),
    Location=pt_29,
    Dummy=Toggle(True),
    Date=date,
    Boundingbox=pt_28,
    PointCloud=pointcloud,
    IFCObject=ifcobject,
    Material=material,
    TransportHistory=jitter_5.Values)  # -> RepositoryComponent; inputs Type: list, Availability: list of Boolean, Location: list of Point3d, Dummy: list of Boolean, Date: list, Boundingbox: list of Point3d, PointCloud: list, IFCObject: list, DOM: list of Int32, Material: list, Process: list, TransportHistory: list, ComponentHistory: list, Geometry: list
# ---------- createrepositorycomponent: Python ----------
"""
Provides a scripting component.
    Inputs:
        x: The x script variable
        y: The y script variable
    Output:
        a: The a output variable
    Remarks:
        Author: Max Eschenbach
        License: MIT License
        Version: 230104
"""

# PYTHON STANDARD LIBRARY IMPORTS
from __future__ import division, print_function
import json
import uuid

# GHPYTHON SDK IMPORTS
from ghpythonlib.componentbase import executingcomponent as component
import Grasshopper, GhPython
import System
import Rhino
import rhinoscriptsyntax as rs

# GHENV COMPONENT SETTINGS
ghenv.Component.Name = "CreateRepositoryComponent"
ghenv.Component.NickName = "CreateRepositoryComponent"
ghenv.Component.Category = "FERTIGTEIL2.0"
ghenv.Component.SubCategory = "02 Datamodel"

class CreateRepositoryComponent(component):
    
    def RunScript(self,
                  Type,
                  Availability,
                  Location,
                  Dummy,
                  Date,
                  Boundingbox,
                  PointCloud,
                  IFCObject,
                  DOM,
                  Material,
                  Process,
                  TransportHistory,
                  ComponentHistory,
                  Geometry):
        
        if not DOM:
            DOM = [-1]
        if not Process:
            Process = [None]
        if not ComponentHistory:
            ComponentHistory = [None]
        if not Geometry:
            Geometry = [None]
        
        # init output list
        RepositoryComponent = []
        
        # base composition and loop on bbx list length
        for i, bbx in enumerate(Boundingbox):
            _type = Type[i] if i < len(Type) else Type[-1]
            _availability = Availability[i] if i < len(Availability) else Availability[-1]
            _location = (Location[i].X, Location[i].Y) if i < len(Location) else (Location[-1].X, Location[-1].Y)
            _dummy = Dummy[i] if i < len(Dummy) else Dummy[-1]
            _date = Date[i] if i < len(Date) else Date[-1]
            _boundingbox = [Boundingbox[i].X, Boundingbox[i].Y, Boundingbox[i].Z]
            _pointcloud = PointCloud[i] if i < len(PointCloud) else PointCloud[-1]
            _ifcobject = IFCObject[i] if i < len(IFCObject) else IFCObject[-1]
            _dom = DOM[i] if i < len(DOM) else DOM[-1]
            _material = Material[i] if i < len(Material) else Material[-1]
            _process = Process[i] if i < len(Process) else Process[-1]
            _transporthistory = json.loads(TransportHistory[i]) if i < len(TransportHistory) else json.loads(TransportHistory[-1]) 
            _componenthistory = ComponentHistory[i] if i < len(ComponentHistory) else ComponentHistory[-1]
            _geometry = Geometry[i] if i < len(Geometry) else Geometry[-1]
            
            # create dict for json conversion
            compdict = {
                'uid': str(uuid.uuid4()),
                'type': _type,
                'availability': _availability,
                'location': _location,
                'dummy': _dummy,
                'date': _date,
                'boundingbox': _boundingbox,
                'pointcloud': _pointcloud,
                'ifcobject': _ifcobject,
                'dom': _dom,
                'material': _material,
                'process': _process,
                'transporthistory': _transporthistory,
                'componenthistory': _componenthistory,
                'geometry': _geometry
                }
            
            # create json string 
            RepositoryComponent.append(json.dumps(compdict))
        
        # return outputs if you have them; here I try it for you:
        return RepositoryComponent
# ---------- end createrepositorycomponent ----------
repository_columns = Data(createrepositorycomponent)

# ----
# comments & notes: randomize assignment of transport history
transporthistory_tudacampus_3 = Data(transporthistory_tudacampus)
transporthistory_bpstuttgart_3 = Data(transporthistory_bpstuttgart)
transporthistory_chemiegeb_3 = Data(transporthistory_chemiegeb)
jitterseed_6 = Slider(739317, range=0..1000000)
repository_amount_6 = Integer(repository_amount)
repo_beam_len_2 = Number(repo_beam_len)
repo_beam_csx_2 = Number(repo_beam_csx)
repo_beam_csy_2 = Number(repo_beam_csy)
braunschweig_dbfl_3 = Panel("52.284726")
material_2 = Panel("1.4.01 (Beton 30/37)")
pointcloud_2 = Panel("")
ifcobject_2 = Panel("")
merge_7 = Merge(Data1=transporthistory_chemiegeb_3, Data2=transporthistory_tudacampus_3, Data3=transporthistory_bpstuttgart_3)
date_2 = Panel("")
pt_30 = ConstructPoint(XCoordinate=repo_beam_len_2, YCoordinate=repo_beam_csx_2, ZCoordinate=repo_beam_csy_2)
pt_31 = ConstructPoint(XCoordinate=braunschweig_dbfl_3, YCoordinate="10.548717", ZCoordinate=0)
type_2 = Panel("Beam")
repeat_27 = RepeatData(Data=merge_7, Length=repository_amount_6)
jitter_6 = Jitter(List=repeat_27, Jitter=1, Seed=jitterseed_6)  # -> Values, Indices
comments_notes_3 = Panel("""COMPONENT REPOSITORY
BEAMS GENERATED""")
createrepositorycomponent_2 = CreateRepositoryComponent(
    Type=type_2,
    Availability=Toggle(True),
    Location=pt_31,
    Dummy=Toggle(True),
    Date=date_2,
    Boundingbox=pt_30,
    PointCloud=pointcloud_2,
    IFCObject=ifcobject_2,
    Material=material_2,
    TransportHistory=jitter_6.Values)  # -> RepositoryComponent; inputs Type: list, Availability: list of Boolean, Location: list of Point3d, Dummy: list of Boolean, Date: list, Boundingbox: list of Point3d, PointCloud: list, IFCObject: list, DOM: list of Int32, Material: list, Process: list, TransportHistory: list, ComponentHistory: list, Geometry: list; same code as createrepositorycomponent
repository_beams = Data(createrepositorycomponent_2)

# ----
# comments & notes: NEW PRODUCTION IMPACT COEFFICIENTS
processing_impact = Panel("4.317632258")
raw_materials_manufacturing_impact = Panel("497.7596612")
demolition_impact = Panel("19.13786875")
transport_to_landfill_per_m3_and_km = Panel("0.18772117")
transport_raw_materials_impact = Panel("18.75741264")
fabrication_impact = Panel("3.76984123")
transport_to_site_impact_per_m3_and_km = Panel("0.206287")
assembly_and_installation_impact = Panel("3.952943913")
productionimpactcoefficients = ProductionImpactCoefficients(
    Demolition=demolition_impact,
    TransportLandfill=transport_to_landfill_per_m3_and_km,
    Processing=processing_impact,
    RawMatManufacturing=raw_materials_manufacturing_impact,
    TransportRawMat=transport_raw_materials_impact,
    Fabrication=fabrication_impact,
    TransportSite=transport_to_site_impact_per_m3_and_km,
    Assembly=assembly_and_installation_impact)  # -> ProductionCoeffs
# ---------- productionimpactcoefficients: Python ----------
"""
Compile new production impact coefficients for matchmaking optimization.
    Inputs:
        Demolition: The impact coefficient for demolition.
                     {item, float}
        TransportLandfill: The impact coefficient for transport to a landfill.
                           {item, float}
        Processing: The impact coefficient for processing of raw materials.
                     {item, float}
        RawMatManufacturing: The impact coefficient for raw materials
                             manufacturing.
                             {item, float}
        TransportRawMat: The impact coefficient for transport of raw materials.
                         {item, float}
        Fabrication: The impact coefficient for fabrication.
                     {item, float}
        TransportSite: The impact coefficient for transport to the site.
                       {item, float}
        Assembly: The impact coefficient for on-site assembly.
                  {item, float}
    Output:
        ProductionCoeffs: The compiled new production coefficients for the
                          matchmaking optimization.
                          {item, str}
    Remarks:
        Author: Max Eschenbach
        License: MIT License
        Version: 230105
"""

# PYTHON STANDARD LIBRARY IMPORTS
from __future__ import division, print_function
import json

# GHPYTHON SDK IMPORTS
from ghpythonlib.componentbase import executingcomponent as component
import Grasshopper, GhPython
import System
import Rhino
import rhinoscriptsyntax as rs

# GHENV COMPONENT SETTINGS
ghenv.Component.Name = "ProductionImpactCoefficients"
ghenv.Component.NickName = "ProductionImpactCoefficients"
ghenv.Component.Category = "FERTIGTEIL2.0"
ghenv.Component.SubCategory = "02 Datamodel"

class ProductionImpactCoefficients(component):
    
    def RunScript(self,
                  Demolition,
                  TransportLandfill,
                  Processing,
                  RawMatManufacturing,
                  TransportRawMat,
                  Fabrication,
                  TransportSite,
                  Assembly):
        
        # create dict for json conversion
        ProductionCoeffs = {
            'demolition': Demolition,
            'transport_landfill': TransportLandfill,
            'processing': Processing,
            'rawmat_manufacturing': RawMatManufacturing,
            'transport_rawmat': TransportRawMat,
            'fabrication': Fabrication,
            'transport_site' : TransportSite,
            'assembly': Assembly
            }
        
        # create json string 
        ProductionCoeffs = json.dumps(ProductionCoeffs)
        
        # return outputs if you have them; here I try it for you:
        return ProductionCoeffs
# ---------- end productionimpactcoefficients ----------
panel_4 = Panel(productionimpactcoefficients)
production_coefficients = Data(productionimpactcoefficients)

comments_notes_4 = Panel("FT2.0 REUSE IMPACT COEFFICIENTS")
disassembly_ft2_0_impact = Panel("47.08069567")
transport_to_lab_ft2_0_impact_per_m3_and = Panel("0.3094305")  # "Transport to Lab FT2.0 Impact (per m3 and km)"
fabrication_ft2_0_impact = Panel("5.746805556")
transport_to_site_ft2_0_impact_per_m3_an = Panel("0.206287")  # "Transport to Site FT2.0 Impact (per m3 and km)"
assembly_and_installation_ft2_0_impact = Panel("30.95864832")
reuseimpactcoefficients = ReUseImpactCoefficients(
    Disassembly=disassembly_ft2_0_impact,
    TransportLab=transport_to_lab_ft2_0_impact_per_m3_and,
    Fabrication=fabrication_ft2_0_impact,
    TransportSite=transport_to_site_ft2_0_impact_per_m3_an,
    Assembly=assembly_and_installation_ft2_0_impact)  # -> ReUseCoeffs
# ---------- reuseimpactcoefficients: Python ----------
"""
Compile reuse impact coefficients for matchmaking optimization.
    Inputs:
        Disassembly: The impact coefficient for disassembly.
                     {item, float}
        TransportLab: The impact coefficient for transport to the lab.
                      {item, float}
        Fabrication: The impact coefficient for fabrication.
                     {item, float}
        TransportSite: The impact coefficient for transport to the site.
                       {item, float}
        Assembly: The impact coefficient for on-site assembly.
                  {item, float}
    Output:
        ReUseCoeffs: The compiled reuse coefficients for the matchmaking
                     optimization.
                     {item, str}
    Remarks:
        Author: Max Eschenbach
        License: MIT License
        Version: 230105
"""

# PYTHON STANDARD LIBRARY IMPORTS
from __future__ import division, print_function
import json

# GHPYTHON SDK IMPORTS
from ghpythonlib.componentbase import executingcomponent as component
import Grasshopper, GhPython
import System
import Rhino
import rhinoscriptsyntax as rs

# GHENV COMPONENT SETTINGS
ghenv.Component.Name = "ReUseImpactCoefficients"
ghenv.Component.NickName = "ReUseImpactCoefficients"
ghenv.Component.Category = "FERTIGTEIL2.0"
ghenv.Component.SubCategory = "02 Datamodel"

class ReUseImpactCoefficients(component):
    
    def RunScript(self, Disassembly, TransportLab, Fabrication, TransportSite, Assembly):
        
        # create dict for json conversion
        ReUseCoeffs = {
            'disassembly' : Disassembly,
            'transport_lab' : TransportLab,
            'fabrication' : Fabrication,
            'transport_site' : TransportSite,
            'assembly' : Assembly
            }
        
        # create json string 
        ReUseCoeffs = json.dumps(ReUseCoeffs)
        
        # return outputs if you have them; here I try it for you:
        return ReUseCoeffs
# ---------- end reuseimpactcoefficients ----------
panel_5 = Panel(reuseimpactcoefficients)
reuse_coefficients = Data(reuseimpactcoefficients)

# ----
# comments & notes: GET ALL OBJECTS ON REPOSITORY SERVER
panel_6 = Panel("http://localhost:5000/ft20.GetAllObjects")
hops = Hops(
    _Path=panel_6,
    Refresh=Button(),
    CacheResultsInMemory=False,
    CacheSolveResults=False,
    RemoteDefinitionLocation="http://localhost:5000/ft20.GetAllObjects",
    RemoteSolveVersion=(0, 1, 0),
    ShowInput_Enabled=False,
    ShowInput_Path=True,
    SynchronousSolve=False)
panel_7 = Panel(hops)
repository_components = Data(hops)

# ----
# comments & notes: CLEAR SERVER BY DELETING ALL OBJECTS
panel_8 = Panel("http://localhost:5000/ft20.ClearServer")
hops_2 = Hops(
    _Path=panel_8,
    Clear=Button(),
    CacheResultsInMemory=False,
    CacheSolveResults=False,
    RemoteDefinitionLocation="http://localhost:5000/ft20.ClearServer",
    RemoteSolveVersion=(0, 1, 0),
    ShowInput_Enabled=False,
    ShowInput_Path=True,
    SynchronousSolve=False)

# ----
# comments & notes: CREATE OBJECTS ON SERVER
panel_9 = Panel("http://localhost:5000/ft20.CreateObject")
repository_columns_2 = Data(repository_columns)
repository_beams_2 = Data(repository_beams)
merge_8 = Merge(Data1=repository_columns_2, Data2=repository_beams_2)
hops_3 = Hops(
    _Path=panel_9,
    Create=Button(),
    RepositoryComponents=merge_8,
    CacheResultsInMemory=False,
    CacheSolveResults=False,
    RemoteDefinitionLocation="http://localhost:5000/ft20.CreateObject",
    RemoteSolveVersion=(0, 1, 0),
    ShowInput_Enabled=False,
    ShowInput_Path=True,
    SynchronousSolve=False)

# ----
# comments & notes: filter columns and beams
repository_components_2 = Data(merge_8)
filtercomponenttype = FilterComponentType(Components=repository_components_2)  # -> ColumnType, BeamType; inputs Components: list
# ---------- filtercomponenttype: Python ----------
"""
Sorts all input components into 'Column' and 'Beam' type outputs.
    Inputs:
        Components: The components to filter for types. {list, str}
    Output:
        ColumnType: All components of type 'Column'. {list, str}
        BeamType: All components of type 'Beam'. {list, str}
    Remarks:
        Author: Max Eschenbach
        License: MIT License
        Version: 230105
"""

# PYTHON STANDARD LIBRARY IMPORTS
from __future__ import division, print_function
import json

# GHPYTHON SDK IMPORTS
from ghpythonlib.componentbase import executingcomponent as component
import Grasshopper, GhPython
import System
import Rhino
import rhinoscriptsyntax as rs

# GHENV COMPONENT SETTINGS
ghenv.Component.Name = "FilterComponentType"
ghenv.Component.NickName = "FilterComponentType"
ghenv.Component.Category = "FERTIGTEIL2.0"
ghenv.Component.SubCategory = "02 Datamodel"

class FilterComponentType(component):
    
    def RunScript(self, Components):
        
        # create dict for json conversion
        if Components:
            ColumnType = []
            BeamType = []
            for comp in Components:
                compdict = json.loads(comp)
                if compdict['type'] == 'Column':
                    ColumnType.append(comp)
                elif compdict['type'] == 'Beam':
                    BeamType.append(comp)
            return ColumnType, BeamType
        else:
            return (Grasshopper.DataTree[object](),
                    Grasshopper.DataTree[object]())
# ---------- end filtercomponenttype ----------
repository_columns_3 = Data(filtercomponenttype.ColumnType)
repository_beams_3 = Data(filtercomponenttype.BeamType)

cutloss = Slider(0.01, range=0..0.1)

comments_notes_5 = Panel("VISUALISATION CONTROLS")
renderrepository = BooleanToggle(True)
displaycurvecolor = ColourSwatch(SwatchColor=RGB(0, 0, 0))
viz_label_text_size = Slider(0.125, range=0..1)
displaytextcolor = ColourSwatch(SwatchColor=RGB(0, 0, 0))
displayresultshud = BooleanToggle(True)

# ----
# comments & notes: DEMAND DEFINITION FROM GEOMETRY PIPELINE
brep = Brep(branch)
bbox_3 = BoundingBox(Content=brep, Plane=PlaneXY(0, 0, 0))  # -> Box, Box_2
debox = DeconstructBox(Box=bbox_3.Box)  # -> Plane, X, Y, Z
bbox_4 = BoundingBox(Content=brep, Plane=PlaneXY(0, 0, 0), UnionBox=True)  # -> Box, Box_2
demand_geo_bbx = Data(bbox_4.Box)
dedomain = DeconstructDomain(Domain=debox.X)  # -> Start, End
dedomain_2 = DeconstructDomain(Domain=debox.Y)  # -> Start, End
dedomain_3 = DeconstructDomain(Domain=debox.Z)  # -> Start, End
subtraction_3 = Subtraction(A=dedomain_2.End, B=dedomain_2.Start)
subtraction_4 = Subtraction(A=dedomain.End, B=dedomain.Start)
subtraction_5 = Subtraction(A=dedomain_3.End, B=dedomain_3.Start)
max = Maximum(A=subtraction_4, B=subtraction_3)
larger = LargerThan(FirstNumber=subtraction_5, SecondNumber=max)  # -> LargerThan, OrEqualTo
dispatch = Dispatch(List=brep, DispatchPattern=larger.LargerThan)  # -> ListA, ListB
dispatch_2 = Dispatch(List=subtraction_4, DispatchPattern=larger.LargerThan)  # -> ListA, ListB
dispatch_3 = Dispatch(List=subtraction_3, DispatchPattern=larger.LargerThan)  # -> ListA, ListB
dispatch_4 = Dispatch(List=subtraction_5, DispatchPattern=larger.LargerThan)  # -> ListA, ListB
dispatch_5 = Dispatch(List=bbox_3.Box, DispatchPattern=larger.LargerThan)  # -> ListA, ListB
column_geo = Data(dispatch.ListA)
column_bbx = Data(dispatch_5.ListA)
other_geo = Data(dispatch.ListB)
other_bbx = Data(dispatch_5.ListB)
column_x = Data(dispatch_2.ListA)
column_y = Data(dispatch_3.ListA)
column_z = Data(dispatch_4.ListA)
other_x = Data(dispatch_2.ListB)
other_y = Data(dispatch_3.ListB)
other_z = Data(dispatch_4.ListB)
slab_threshold_z = Slider(1.6, range=0..2)
larger_2 = LargerThan(FirstNumber=other_x, SecondNumber=slab_threshold_z)  # -> LargerThan, OrEqualTo
larger_3 = LargerThan(FirstNumber=other_y, SecondNumber=slab_threshold_z)  # -> LargerThan, OrEqualTo
and = GateAnd(A=larger_2.LargerThan, B=larger_3.LargerThan)
dispatch_6 = Dispatch(List=other_geo, DispatchPattern=and)  # -> ListA, ListB
dispatch_7 = Dispatch(List=other_x, DispatchPattern=and)  # -> ListA, ListB
dispatch_8 = Dispatch(List=other_y, DispatchPattern=and)  # -> ListA, ListB
dispatch_9 = Dispatch(List=other_z, DispatchPattern=and)  # -> ListA, ListB
dispatch_10 = Dispatch(List=other_bbx, DispatchPattern=and)  # -> ListA, ListB
beam_geo = Data(dispatch_6.ListB)
beam_bbx = Data(dispatch_10.ListB)
slab_geo = Data(dispatch_6.ListA)
slab_bbx = Data(dispatch_10.ListA)
beam_x = Data(dispatch_7.ListB)
beam_z = Data(dispatch_9.ListB)
beam_y = Data(dispatch_8.ListB)
slab_x = Data(dispatch_7.ListA)
slab_y = Data(dispatch_8.ListA)
slab_z = Data(dispatch_9.ListA)
beam_geo_2 = Data(beam_geo)
beam_bbx_2 = Data(beam_bbx)
slab_geo_2 = Data(slab_geo)
slab_bbx_2 = Data(slab_bbx)
beam_z_2 = Data(beam_z)
beam_x_2 = Data(beam_x)
beam_y_2 = Data(beam_y)
slab_y_2 = Data(slab_y)
slab_z_2 = Data(slab_z)
slab_x_2 = Data(slab_x)
larger_4 = LargerThan(FirstNumber=beam_x_2, SecondNumber=beam_y_2)  # -> LargerThan, OrEqualTo
dispatch_11 = Dispatch(List=simplify(graft(beam_y_2)), DispatchPattern=invert(simplify(graft(larger_4.LargerThan))))  # -> ListA, ListB
dispatch_12 = Dispatch(List=simplify(graft(beam_x_2)), DispatchPattern=simplify(graft(larger_4.LargerThan)))  # -> ListA, ListB
debox_2 = DeconstructBox(Box=beam_bbx_2)  # -> Plane, X, Y, Z
beam_shorty = Data(dispatch_11.ListB)
beam_longx = Data(dispatch_12.ListA)
beam_shortx = Data(dispatch_12.ListB)
beam_longy = Data(dispatch_11.ListA)
dedomain_4 = DeconstructDomain(Domain=debox_2.X)  # -> Start, End
dedomain_5 = DeconstructDomain(Domain=debox_2.Y)  # -> Start, End
dedomain_6 = DeconstructDomain(Domain=debox_2.Z)  # -> Start, End
column_bbx_2 = Data(column_bbx)
column_geo_2 = Data(column_geo)
columns_z = Data(column_z)
columns_x = Data(column_x)
columns_y = Data(column_y)
merge_9 = Merge(Data1=beam_longx, Data2=beam_longy)  # -> flatten(Result)
merge_10 = Merge(Data1=beam_shortx, Data2=beam_shorty)  # -> flatten(Result)
dispatch_13 = Dispatch(List=graft(dedomain_5.Start), DispatchPattern=invert(graft(larger_4.LargerThan)))  # -> ListA, ListB
dispatch_14 = Dispatch(List=graft(dedomain_5.Start), DispatchPattern=invert(graft(larger_4.LargerThan)))  # -> ListA, ListB
dispatch_15 = Dispatch(List=graft(dedomain_4.Start), DispatchPattern=graft(larger_4.LargerThan))  # -> ListA, ListB
dispatch_16 = Dispatch(List=graft(dedomain_4.Start), DispatchPattern=graft(larger_4.LargerThan))  # -> ListA, ListB
larger_5 = LargerThan(FirstNumber=columns_x, SecondNumber=columns_y)  # -> LargerThan, OrEqualTo
larger_6 = LargerThan(FirstNumber=merge_10, SecondNumber=beam_z_2)  # -> LargerThan, OrEqualTo
debox_3 = DeconstructBox(Box=column_bbx_2)  # -> Plane, X, Y, Z
X = UnitX(Factor=1)
Y = UnitY(Factor=1)
dispatch_17 = Dispatch(List=simplify(graft(columns_y)), DispatchPattern=invert(simplify(graft(larger_5.LargerThan))))  # -> ListA, ListB
dispatch_18 = Dispatch(List=simplify(graft(columns_x)), DispatchPattern=simplify(graft(larger_5.LargerThan)))  # -> ListA, ListB
merge_11 = Merge(Data1=simplify(dispatch_16.ListA), Data2=simplify(dispatch_14.ListA))  # -> flatten(Result)
dispatch_19 = Dispatch(List=simplify(graft(beam_z_2)), DispatchPattern=invert(simplify(graft(larger_6.LargerThan))))  # -> ListA, ListB
merge_12 = Merge(Data1=simplify(dispatch_15.ListB), Data2=simplify(dispatch_13.ListB))
dispatch_20 = Dispatch(List=simplify(graft(merge_10)), DispatchPattern=simplify(graft(larger_6.LargerThan)))  # -> ListA, ListB
merge_13 = Merge(Data1=X, Data2=Y)
division = Division(A=flatten(beam_z_2), B="2")
division_2 = Division(A=merge_10, B="2")
dedomain_7 = DeconstructDomain(Domain=debox_3.X)  # -> Start, End
dedomain_8 = DeconstructDomain(Domain=debox_3.Y)  # -> Start, End
dedomain_9 = DeconstructDomain(Domain=debox_3.Z)  # -> Start, End
column_shorty = Data(dispatch_17.ListB)
column_longx = Data(dispatch_18.ListA)
column_shortx = Data(dispatch_18.ListB)
column_longy = Data(dispatch_17.ListA)
item_2 = ListItem(List=merge_13, Index=larger_4.LargerThan, Wrap=True)
addition = Addition(A=flatten(merge_12), B=division_2)
subtraction_6 = Subtraction(A=dedomain_8.End, B=dedomain_8.Start)
subtraction_7 = Subtraction(A=dedomain_7.End, B=dedomain_7.Start)
addition_2 = Addition(A=flatten(dedomain_6.Start), B=division)
subtraction_8 = Subtraction(A=dedomain_9.End, B=dedomain_9.Start)
beam_shorty_2 = Data(dispatch_20.ListB)
beam_shortz = Data(dispatch_19.ListB)
beam_longy_2 = Data(dispatch_20.ListA)
beam_longz = Data(dispatch_19.ListA)
Z = UnitZ(Factor=1)
lng_3 = ListLength(List=item_2)
Y_2 = UnitY(Factor=1)
X_2 = UnitX(Factor=1)
number_slider = Slider(2, range=0..10)
merge_14 = Merge(Data1=beam_longy_2, Data2=beam_longz)  # -> flatten(Result)
merge_15 = Merge(Data1=beam_shorty_2, Data2=beam_shortz)  # -> flatten(Result)
number_slider_2 = Slider(2, range=0..10)
pt_32 = ConstructPoint(XCoordinate=addition, YCoordinate=merge_11, ZCoordinate=addition_2)
pt_33 = ConstructPoint(XCoordinate=merge_11, YCoordinate=addition, ZCoordinate=addition_2)
dup = DuplicateData(Data=Z, Number=lng_3, Order=True)
merge_16 = Merge(Data1=column_shortx, Data2=column_shorty)  # -> flatten(Result)
merge_17 = Merge(Data1=column_longx, Data2=column_longy)  # -> flatten(Result)
division_3 = Division(A=subtraction_7, B="2")
division_4 = Division(A=subtraction_6, B="2")
merge_18 = Merge(Data1=Y_2, Data2=X_2)
dispatch_21 = Dispatch(List=graft(pt_33), DispatchPattern=invert(graft(larger_4.LargerThan)))  # -> ListA, ListB
addition_3 = Addition(A=dedomain_7.Start, B=division_3)
addition_4 = Addition(A=dedomain_8.Start, B=division_4)
dispatch_22 = Dispatch(List=graft(pt_32), DispatchPattern=graft(larger_4.LargerThan))  # -> ListA, ListB
item_3 = ListItem(List=merge_18, Index=larger_4.LargerThan, Wrap=True)  # -> flatten(Item)
merge_19 = Merge(Data1=simplify(graft(item_2)), Data2=simplify(graft(dup)))
not = GateNot(A=larger_6.LargerThan)
pt_34 = ConstructPoint(XCoordinate=addition_3, YCoordinate=addition_4, ZCoordinate=dedomain_9.Start)
Z_2 = UnitZ(Factor=1)
merge_20 = Merge(Data1=dispatch_22.ListB, Data2=dispatch_21.ListB)  # -> flatten(Result)
rtd = RoundToDecimal(Numbers=merge_17, DecimalPlaces=number_slider_2)  # -> Rounded; inputs Numbers: list, DecimalPlaces: list of Int32
# ---------- rtd: Python ----------
"""
Rounds input numbers to a decimal place.
    Inputs:
        Numbers: The numbers to round. {list, float}
        DecimalPlaces: Number of decimal places for the generated random
                       numbers. Set to 0 for integer numbers.
                       Defaults to 2.
                       {list, int}
    Output:
        Rounded: The number rounded to DecimalPlaces.
                 {list/tree, float/int}
    Remarks:
        Author: Max Eschenbach
        License: MIT License
        Version: 230103
"""

# PYTHON STANDARD LIBRARY IMPORTS
from __future__ import division, print_function

# GHPYTHONLIB SDK IMPORTS
from ghpythonlib.componentbase import executingcomponent as component
import Grasshopper, GhPython
import System
import Rhino

# GHENV COMPONENT SETTINGS
ghenv.Component.Name = "RoundToDecimal"
ghenv.Component.NickName = "RTD"
ghenv.Component.Category = "FindersKeepers"
ghenv.Component.SubCategory = "5 Math"

class RoundToDecimal(component):
    
    def RunScript(self, Numbers, DecimalPlaces):
        
        if not DecimalPlaces:
                DecimalPlaces = [0]
        
        if Numbers:
            rounded = []
            for i, num in enumerate(Numbers):
                # retrieve decimalplaces
                if i < len(DecimalPlaces):
                    dp = DecimalPlaces[i]
                else:
                    dp = DecimalPlaces[-1]
                # round number
                rounded.append(round(num, dp))
        else:
            rounded = Grasshopper.DataTree[object]()
        
        # return outputs if you have them; here I try it for you:
        return rounded
# ---------- end rtd ----------
rtd_2 = RoundToDecimal(Numbers=merge_16, DecimalPlaces=number_slider_2)  # -> Rounded; inputs Numbers: list, DecimalPlaces: list of Int32; same code as rtd
rtd_3 = RoundToDecimal(Numbers=merge_15, DecimalPlaces=number_slider)  # -> Rounded; inputs Numbers: list, DecimalPlaces: list of Int32; same code as rtd
rtd_4 = RoundToDecimal(Numbers=merge_9, DecimalPlaces=number_slider)  # -> Rounded; inputs Numbers: list, DecimalPlaces: list of Int32; same code as rtd
rtd_5 = RoundToDecimal(Numbers=merge_14, DecimalPlaces=number_slider)  # -> Rounded; inputs Numbers: list, DecimalPlaces: list of Int32; same code as rtd
item_4 = ListItem(List=merge_19, Index=graft(not), Wrap=True)  # -> flatten(Item)
line = LineSDL(Start=pt_34, Direction=Z_2, Length=subtraction_8)
line_2 = LineSDL(Start=merge_20, Direction=item_3, Length=merge_9)
demand_geo_total_bbx = Data(demand_geo_bbx)
pl = PlaneNormal(Origin=merge_20, ZAxis=line_2)
column_geo_3 = Data(column_geo_2)
column_csx = Number(rtd)
column_len = Data(columns_z)
column_csy = Number(rtd_2)
column_ax = Line(line)
beam_geo_3 = Geometry(beam_geo_2)
beam_csy = Number(rtd_3)
beam_len = Number(rtd_4)
beam_csx = Number(rtd_5)
align = AlignPlane(Plane=pl, Direction=item_4)  # -> Plane, Angle
slab_geo_3 = Data(slab_geo_2)
beam_plane = Data(align.Plane)
beam_ax = Line(line_2)

xy_2 = XYPlane(Origin=pt_34)

column_plane = Data(xy_2)

demand_column_len = Data(column_len)
demand_column_csx = Number(column_csx)
demand_column_csy = Number(column_csy)
demand_beam_len = Number(beam_len)
demand_beam_csx = Number(beam_csx)
demand_beam_csy = Number(beam_csy)
frankfurt_site_location = Panel("50.109986")
material_3 = Panel("1.4.01 (Beton 30/37)")
comments_notes_6 = Panel("COMPONENT DEMAND")
pt_35 = ConstructPoint(XCoordinate=demand_column_len, YCoordinate=demand_column_csx, ZCoordinate=demand_column_csy)  # -> flatten(BoundingBox)
pt_36 = ConstructPoint(XCoordinate=demand_beam_len, YCoordinate=demand_beam_csx, ZCoordinate=demand_beam_csy)
date_3 = Panel("")
type_3 = Panel("Column")
type_4 = Panel("Beam")
pt_37 = ConstructPoint(XCoordinate=frankfurt_site_location, YCoordinate="8.671996", ZCoordinate=0)
createdemandcomponent = CreateDemandComponent(Type=type_3, Location=pt_37, Date=date_3, Boundingbox=pt_35, Material=material_3)  # -> DemandComponent; inputs Type: list, Location: list of Point3d, Date: list, Boundingbox: list of Point3d, Material: list, Geometry: list
# ---------- createdemandcomponent: Python ----------
"""
Provides a scripting component.
    Inputs:
        x: The x script variable
        y: The y script variable
    Output:
        a: The a output variable
    Remarks:
        Author: Max Eschenbach
        License: MIT License
        Version: 230105
"""

# PYTHON STANDARD LIBRARY IMPORTS
from __future__ import division, print_function
import json

# GHPYTHON SDK IMPORTS
from ghpythonlib.componentbase import executingcomponent as component
import Grasshopper, GhPython
import System
import Rhino
import rhinoscriptsyntax as rs

# GHENV COMPONENT SETTINGS
ghenv.Component.Name = "CreateDemandComponent"
ghenv.Component.NickName = "CreateDemandComponent"
ghenv.Component.Category = "FERTIGTEIL2.0"
ghenv.Component.SubCategory = "02 Datamodel"

class CreateDemandComponent(component):
    
    def RunScript(self, Type, Location, Date, Boundingbox, Material, Geometry):
        # sanitize input data
        if not Geometry:
            Geometry = [None]
        
        # init output list
        DemandComponent = []
        
        # base composition and loop on bbx list length
        for i, bbx in enumerate(Boundingbox):
            _type = Type[i] if i < len(Type) else Type[-1]
            _location = (Location[i].X, Location[i].Y) if i < len(Location) else (Location[-1].X, Location[-1].Y)
            _date = Date[i] if i < len(Date) else Date[-1]
            _boundingbox = [Boundingbox[i].X, Boundingbox[i].Y, Boundingbox[i].Z]
            _material = Material[i] if i < len(Material) else Material[-1]
            _geometry = Geometry[i] if i < len(Geometry) else Geometry[-1]
            
            # create dict for json conversion
            compdict = {
                'type': _type,
                'location': _location,
                'date': _date,
                'boundingbox': _boundingbox,
                'material': _material,
                'geometry': _geometry
                }
            
            # create json string 
            DemandComponent.append(json.dumps(compdict))
        
        # return outputs if you have them; here I try it for you:
        return DemandComponent
# ---------- end createdemandcomponent ----------
createdemandcomponent_2 = CreateDemandComponent(Type=type_4, Location=pt_37, Date=date_3, Boundingbox=pt_36, Material=material_3)  # -> DemandComponent; inputs Type: list, Location: list of Point3d, Date: list, Boundingbox: list of Point3d, Material: list, Geometry: list; same code as createdemandcomponent
demand_columns = Data(createdemandcomponent)
demand_beams = Data(createdemandcomponent_2)

panel_10 = Panel("http://localhost:5000/ft20.FT20OptimizeMatching")
comments_notes_7 = Panel("MATCHMAKING OPTIMIZATION")
mipgap = Slider(0.05, range=0..0.1)
production_coefficients_2 = Data(production_coefficients)
repository_components_3 = Data(repository_columns_3)
production_coefficients_3 = Data(production_coefficients)
repository_components_4 = Data(repository_beams_3)
demand_components = Data(demand_columns)
demand_components_2 = Data(demand_beams)
reuse_coefficients_2 = Data(reuse_coefficients)
toggle = BooleanToggle(True)
reuse_coefficients_3 = Data(reuse_coefficients)
tstat_2 = TreeStatistics(Tree=repository_components_3)  # -> Paths, Length, Count
tstat_3 = TreeStatistics(Tree=repository_components_4)  # -> Paths, Length, Count
path = ConstructPath(Indices="0")
path_2 = ConstructPath(Indices="0")
replace = ReplacePaths(Data=repository_components_3, Search=tstat_2.Paths, Replace=path)
replace_2 = ReplacePaths(Data=repository_components_3, Search=tstat_3.Paths, Replace=path_2)
hops_4 = Hops(
    _Path=panel_10,
    _Enabled=toggle,
    RepositoryComponents=replace_2,
    DemandComponents=demand_components_2,
    ReUseCoeffs=reuse_coefficients_3,
    ProductionCoeffs=production_coefficients_3,
    CutLoss=cutloss,
    MIPGap=mipgap,
    CacheResultsInMemory=False,
    CacheSolveResults=False,
    RemoteDefinitionLocation="http://localhost:5000/ft20.FT20OptimizeMatching",
    RemoteSolveVersion=(0, 1, 0),
    ShowInput_Enabled=True,
    ShowInput_Path=True,
    SynchronousSolve=False)  # -> Assignment, NewComponents, ResultObjects
hops_5 = Hops(
    _Path=panel_10,
    _Enabled=toggle,
    RepositoryComponents=replace,
    DemandComponents=demand_components,
    ReUseCoeffs=reuse_coefficients_2,
    ProductionCoeffs=production_coefficients_2,
    CutLoss=cutloss,
    MIPGap=mipgap,
    CacheResultsInMemory=False,
    CacheSolveResults=False,
    RemoteDefinitionLocation="http://localhost:5000/ft20.FT20OptimizeMatching",
    RemoteSolveVersion=(0, 1, 0),
    ShowInput_Enabled=True,
    ShowInput_Path=True,
    SynchronousSolve=False)  # -> Assignment, NewComponents, ResultObjects
column_result_objects = Data(hops_5.ResultObjects)
beam_result_objects = Data(hops_4.ResultObjects)
column_assignment = Data(hops_5.Assignment)

repository_components_5 = Data(repository_columns_3)
column_assignment_2 = Data(column_assignment)
demand_components_3 = Data(demand_columns)
number_slider_3 = Slider(18, range=0..50)
item_5 = ListItem(List=column_assignment_2, Index=number_slider_3, Wrap=True)
comments_notes_8 = Panel("COLUMN ASSIGNMENT VALIDATION")
item_6 = ListItem(List=repository_components_5, Index=item_5, Wrap=True)
item_7 = ListItem(List=demand_components_3, Index=number_slider_3, Wrap=True)
componentboundingbox = ComponentBoundingbox(Components=item_7)  # -> LEN, CSX, CSY; inputs Components: list
# ---------- componentboundingbox: Python ----------
"""
Get boundingbox values from components.
    Inputs:
        Components: The components to get boundingbox values for. {list, str}
    Output:
        LEN: The length of the component. {list, float}
        CSX: The larger cross-section of the component. {list, float}
        CSY: The smaller cross-section of the component. {list, float}
    Remarks:
        Author: Max Eschenbach
        License: MIT License
        Version: 230105
"""

# PYTHON STANDARD LIBRARY IMPORTS
from __future__ import division, print_function
import json

# GHPYTHON SDK IMPORTS
from ghpythonlib.componentbase import executingcomponent as component
import Grasshopper, GhPython
import System
import Rhino
import rhinoscriptsyntax as rs

# GHENV COMPONENT SETTINGS
ghenv.Component.Name = "ComponentBoundingbox"
ghenv.Component.NickName = "ComponentBoundingbox"
ghenv.Component.Category = "FERTIGTEIL2.0"
ghenv.Component.SubCategory = "02 Datamodel"

class ComponentBoundingbox(component):
    
    def RunScript(self, Components):
        
        # create dict for json conversion
        if Components:
            LEN = []
            CSX = []
            CSY = []
            for comp in Components:
                compdict = json.loads(comp)
                LEN.append(compdict['boundingbox'][0])
                CSX.append(compdict['boundingbox'][1])
                CSY.append(compdict['boundingbox'][2])
            return LEN, CSX, CSY
        else:
            return (Grasshopper.DataTree[object](),
                    Grasshopper.DataTree[object](),
                    Grasshopper.DataTree[object]())
# ---------- end componentboundingbox ----------
componentuid = ComponentUID(Components=item_6)  # -> UID; inputs Components: list
# ---------- componentuid: Python ----------
"""
Get uid values of component.
    Inputs:
        Components: The components to get boundingbox values for. {list, str}
    Output:
        UID: The uid of the component. {list, str}
    Remarks:
        Author: Max Eschenbach
        License: MIT License
        Version: 230105
"""

# PYTHON STANDARD LIBRARY IMPORTS
from __future__ import division, print_function
import json

# GHPYTHON SDK IMPORTS
from ghpythonlib.componentbase import executingcomponent as component
import Grasshopper, GhPython
import System
import Rhino
import rhinoscriptsyntax as rs

# GHENV COMPONENT SETTINGS
ghenv.Component.Name = "ComponentUID"
ghenv.Component.NickName = "ComponentUID"
ghenv.Component.Category = "FERTIGTEIL2.0"
ghenv.Component.SubCategory = "02 Datamodel"

class ComponentUID(component):
    
    def RunScript(self, Components):
        
        # create dict for json conversion
        if Components:
            UID = []
            for comp in Components:
                compdict = json.loads(comp)
                UID.append(compdict['uid'])
            return UID
        else:
            return Grasshopper.DataTree[object]()
# ---------- end componentuid ----------
componentboundingbox_2 = ComponentBoundingbox(Components=item_6)  # -> LEN, CSX, CSY; inputs Components: list; same code as componentboundingbox
demand = Panel(number_slider_3)
demand_2 = Panel([componentboundingbox.LEN, componentboundingbox.CSX, componentboundingbox.CSY])
repo = Panel([componentboundingbox_2.LEN, componentboundingbox_2.CSX, componentboundingbox_2.CSY])
repo_2 = Panel(item_5)
repo_3 = Panel(componentuid)

beam_assignment = Data(hops_4.Assignment)

repository_components_6 = Data(repository_beams_3)
number_slider_4 = Slider(16, range=0..100)
demand_components_4 = Data(demand_components_2)
beam_assignment_2 = Data(beam_assignment)
item_8 = ListItem(List=beam_assignment_2, Index=number_slider_4, Wrap=True)
comments_notes_9 = Panel("BEAM ASSIGNMENT VALIDATION")
item_9 = ListItem(List=repository_components_6, Index=item_8, Wrap=True)
item_10 = ListItem(List=demand_components_4, Index=number_slider_4, Wrap=True)
componentboundingbox_3 = ComponentBoundingbox(Components=item_10)  # -> LEN, CSX, CSY; inputs Components: list; same code as componentboundingbox
componentuid_2 = ComponentUID(Components=item_9)  # -> UID; inputs Components: list; same code as componentuid
componentboundingbox_4 = ComponentBoundingbox(Components=item_9)  # -> LEN, CSX, CSY; inputs Components: list; same code as componentboundingbox
demand_3 = Panel([componentboundingbox_3.LEN, componentboundingbox_3.CSX, componentboundingbox_3.CSY])
demand_4 = Panel(number_slider_4)
repo_4 = Panel(item_8)
repo_5 = Panel(componentuid_2)
repo_6 = Panel([componentboundingbox_4.LEN, componentboundingbox_4.CSX, componentboundingbox_4.CSY])

# ----
# comments & notes: COLUMN REPOSITORY RESULT PREP FOR VISUALIZATION
column_result_objects_2 = Data(column_result_objects)
repository_columns_4 = Data(repository_columns_3)
groupcomponents = GroupComponents(Components=repository_columns_4, Reverse=Toggle(False))  # -> ComponentGroups, IndexMap; inputs Components: list, Reverse: Boolean
# ---------- groupcomponents: Python ----------
"""
Group components by cross-section (first CSX, then CSY), sorted by length.
    Inputs:
        Components: The components to group. {list, str}
        Reverse: Reverse length sorting. {item, bool}
    Output:
        ComponentGroups: The grouped components {tree, str}
    Remarks:
        Author: Max Eschenbach
        License: MIT License
        Version: 230116
"""

# PYTHON STANDARD LIBRARY IMPORTS
from __future__ import division, print_function
import json

# GHPYTHON SDK IMPORTS
from ghpythonlib.componentbase import executingcomponent as component
import Grasshopper, GhPython
import System
import Rhino
import rhinoscriptsyntax as rs
from ghpythonlib import treehelpers as th

# GHENV COMPONENT SETTINGS
ghenv.Component.Name = "GroupComponents"
ghenv.Component.NickName = "GroupComponents"
ghenv.Component.Category = "FERTIGTEIL2.0"
ghenv.Component.SubCategory = "02 Datamodel"

class GroupComponents(component):
    
    def _get_len(self, component):
        return component['boundingbox'][0]
    
    
    def _tpl_get_len(self, elem):
        return elem[0]['boundingbox'][0]
    
    
    def RunScript(self, Components, ReverseLength=False):
        
        comp_dicts = [json.loads(comp) for comp in Components]
        
        set_csx = sorted(list(set([comp['boundingbox'][1] for comp in comp_dicts])), reverse=True)
        
        groups = [[] for _ in range(len(set_csx))]
        idx = [[] for _ in range(len(set_csx))]
        for i, comp in enumerate(comp_dicts):
            groups[set_csx.index(comp['boundingbox'][1])].append(comp)
            idx[set_csx.index(comp['boundingbox'][1])].append(i)
        
        nested_groups = []
        nested_idx = []
        for i, group in enumerate(groups):
            set_csy = sorted(list(set([comp['boundingbox'][2] for comp in group])),
                             reverse=True)
            subgroups = [[] for _ in range(len(set_csy))]
            sub_idx = [[] for _ in range(len(set_csy))]
            for j, comp in enumerate(group):
                subgroups[set_csy.index(comp['boundingbox'][2])].append(comp)
                sub_idx[set_csy.index(comp['boundingbox'][2])].append(idx[i][j])
            
            sg_tuples = [zip(*sorted(zip(subgroups[k], sub_idx[k]), key=self._tpl_get_len, reverse=ReverseLength)) for k in range(len(subgroups))]
            subgroups = [elem[0] for elem in sg_tuples]
            sub_idx = [elem[1] for elem in sg_tuples]
            
            subgroups = [[json.dumps(comp) for comp in sg] for sg in subgroups]
            nested_groups.append(subgroups)
            nested_idx.append(sub_idx)
        
        ComponentGroups = th.list_to_tree(nested_groups)
        IndexMap = th.list_to_tree(nested_idx)
        
        # return outputs if you have them; here I try it for you:
        return ComponentGroups, IndexMap
# ---------- end groupcomponents ----------
componentuid_3 = ComponentUID(Components=column_result_objects_2)  # -> UID; inputs Components: list; same code as componentuid
componentgroups = Data(groupcomponents.ComponentGroups)
len = TextLength(Text=componentuid_3)
larger_7 = LargerThan(FirstNumber=len, SecondNumber="0")  # -> LargerThan, OrEqualTo
column_result_objects_3 = Data(column_result_objects_2)
dispatch_pattern_reuse_np = Data(larger_7.LargerThan)
dispatch_pattern_reuse_np_2 = Data(dispatch_pattern_reuse_np)
dispatch_23 = Dispatch(List=column_result_objects_3, DispatchPattern=dispatch_pattern_reuse_np_2)  # -> ListA, ListB
x_spacing = Slider(2, range=0.1..3)
y_spacing = Slider(2, range=0.1..3)
componentgroups_2 = Data(componentgroups)
column_np_result_objects = Data(dispatch_23.ListB)
pt_38 = Point(Point(0, 0, 0))
tstat_4 = TreeStatistics(Tree=componentgroups_2)  # -> Paths, Length, Count
column_result_objects_4 = Data(column_result_objects_2)
xy_3 = XYPlane(Origin=pt_38)
X_3 = UnitX(Factor=x_spacing)
groupcomponents_2 = GroupComponents(Components=column_np_result_objects, Reverse=Toggle(False))  # -> ComponentGroups, IndexMap; inputs Components: list, Reverse: Boolean; same code as groupcomponents
arrlinear = LinearArray(Geometry=xy_3, Direction=X_3, Count=expr("x+1", tstat_4.Count))  # -> Geometry, Transform
split = SplitList(List=arrlinear.Geometry, Index=tstat_4.Count)  # -> ListA, ListB
Y_3 = UnitY(Factor=y_spacing)
componentgroups_3 = Data(componentgroups)
tstat_5 = TreeStatistics(Tree=groupcomponents_2.ComponentGroups)  # -> Paths, Length, Count
dispatch_24 = Dispatch(List=componentuid_3, DispatchPattern=dispatch_pattern_reuse_np_2)  # -> ListA, ListB
arrlinear_2 = LinearArray(Geometry=split.ListA, Direction=Y_3, Count=tstat_4.Length)  # -> Geometry, Transform
deconstructresultobject = DeconstructResultObject(ResultObject=column_result_objects_4)  # -> idDemand, StockIndex, ReUse, Boundingbox, Volume, Utilization, Deconstruction, Demolition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
# ---------- deconstructresultobject: Python ----------
"""
Provides a scripting component.
    Inputs:
        ResultObject: The result object output from the MIP optimization.
    Output:
        a: The a output variable
    Remarks:
        Author: Max Eschenbach
        License: MIT License
        Version: 230105
"""

# PYTHON STANDARD LIBRARY IMPORTS
from __future__ import division, print_function
import json

# GHPYTHON SDK IMPORTS
from ghpythonlib.componentbase import executingcomponent as component
import Grasshopper, GhPython
import System
import Rhino
import rhinoscriptsyntax as rs

# GHENV COMPONENT SETTINGS
ghenv.Component.Name = "DeconstructResultObject"
ghenv.Component.NickName = "DeconstructResultObject"
ghenv.Component.Category = "FERTIGTEIL2.0"
ghenv.Component.SubCategory = "02 Datamodel"

class DeconstructResultObject(component):
    
    def RunScript(self, ResultObject):
        
        if ResultObject:
            obj = json.loads(ResultObject)
            idDemand = obj['id']
            StockIndex = obj['stock_index']
            ReUse = obj['reuse']
            Boundingbox = obj['boundingbox']
            Volume = obj['volume']
            Utilization = obj['utilization']
            Deconstruction = obj['impacts']['demo_decon'] if ReUse else 0
            Demolition = obj['impacts']['demo_decon'] if not ReUse else 0
            TransportLab = obj['impacts']['transport_lab']
            Processing = obj['impacts']['processing']
            RawMatManufacturing = obj['impacts']['rawmat_man']
            RawMatTransport = obj['impacts']['rawmat_trans']
            Fabrication = obj['impacts']['fabrication']
            TransportSite = obj['impacts']['transport_site']
            AssemblyInstallation = obj['impacts']['assembly']
            
            # return outputs if you have them; here I try it for you:
            return (idDemand,
                    StockIndex,
                    ReUse,
                    Boundingbox,
                    Volume,
                    Utilization,
                    Deconstruction,
                    Demolition,
                    TransportLab,
                    Processing,
                    RawMatManufacturing,
                    RawMatTransport,
                    Fabrication,
                    TransportSite,
                    AssemblyInstallation)
# ---------- end deconstructresultobject ----------
componentboundingbox_5 = ComponentBoundingbox(Components=column_result_objects_4)  # -> LEN, CSX, CSY; inputs Components: list; same code as componentboundingbox
dispatch_pattern_reuse_np_3 = Data(dispatch_pattern_reuse_np)
componentboundingbox_6 = ComponentBoundingbox(Components=componentgroups_3)  # -> LEN, CSX, CSY; inputs Components: list; same code as componentboundingbox
componentuid_4 = ComponentUID(Components=componentgroups_3)  # -> UID; inputs Components: list; same code as componentuid
unflatten = UnflattenTree(Tree=flatten(arrlinear_2.Geometry), Guide=componentgroups_2)
arrlinear_3 = LinearArray(Geometry=split.ListB, Direction=X_3, Count=tstat_5.Count)  # -> Geometry, Transform
Y_4 = UnitY(Factor=y_spacing)
repo_column_grp_viz_planes = Data(unflatten)
repo_column_grp_viz_planes_2 = Data(repo_column_grp_viz_planes)
repo_column_grp_len = Number(componentboundingbox_6.LEN)
repo_column_grp_csy = Number(componentboundingbox_6.CSY)
repo_column_grp_csx = Number(componentboundingbox_6.CSX)
repo_column_uid = Data(componentuid_4)
repo_column_uid_2 = Data(repo_column_uid)
mindex = MemberIndex(Set=flatten(repo_column_uid_2), Member=dispatch_24.ListA)  # -> flatten(Index), Count
arrlinear_4 = LinearArray(Geometry=arrlinear_3.Geometry, Direction=Y_4, Count=tstat_5.Length)  # -> Geometry, Transform
unflatten_2 = UnflattenTree(Tree=flatten(arrlinear_4.Geometry), Guide=groupcomponents_2.ComponentGroups)
dispatch_25 = Dispatch(List=componentboundingbox_5.LEN, DispatchPattern=dispatch_pattern_reuse_np_3)  # -> ListA, ListB
dispatch_26 = Dispatch(List=componentboundingbox_5.CSX, DispatchPattern=dispatch_pattern_reuse_np_3)  # -> ListA, ListB
dispatch_27 = Dispatch(List=componentboundingbox_5.CSY, DispatchPattern=dispatch_pattern_reuse_np_3)  # -> ListA, ListB
dispatch_28 = Dispatch(List=deconstructresultobject.idDemand, DispatchPattern=dispatch_pattern_reuse_np_3)  # -> ListA, ListB
dispatch_29 = Dispatch(List=deconstructresultobject.StockIndex, DispatchPattern=dispatch_pattern_reuse_np_3)  # -> ListA, ListB
np_column_viz_planes = Data(unflatten_2)
item_11 = ListItem(List=flatten(repo_column_uid_2), Index=mindex.Index, Wrap=True)
item_12 = ListItem(List=flatten(repo_column_grp_viz_planes_2), Index=mindex.Index, Wrap=True)
column_reuse_demand_indices = Data(dispatch_28.ListA)
column_repo_reuse_indices = Integer(dispatch_29.ListA)
column_np_demand_indices = Data(dispatch_28.ListB)
column_reuse_viz_planes = Data(item_12)
column_reuse_len = Data(dispatch_25.ListA)
column_reuse_uids = Data(item_11)
column_reuse_csx = Data(dispatch_26.ListA)
column_reuse_csy = Data(dispatch_27.ListA)
column_np_csx = Data(dispatch_26.ListB)
column_np_csy = Data(dispatch_27.ListB)
column_np_len = Data(dispatch_25.ListB)

# ----
# comments & notes: BEAM REPOSITORY RESULT PREP FOR VISUALIZATION
beam_result_objects_2 = Data(beam_result_objects)
repository_beams_4 = Data(repository_beams_3)
groupcomponents_3 = GroupComponents(Components=repository_beams_4, Reverse=Toggle(True))  # -> ComponentGroups, IndexMap; inputs Components: list, Reverse: Boolean; same code as groupcomponents
np_column_viz_planes_2 = Data(np_column_viz_planes)
repo_column_grp_viz_planes_3 = Data(repo_column_grp_viz_planes)
lng_4 = ListLength(List=np_column_viz_planes_2)
smaller = SmallerThan(FirstNumber=lng_4, SecondNumber="1")  # -> SmallerThan, OrEqualTo
componentgroups_4 = Data(groupcomponents_3.ComponentGroups)
componentuid_5 = ComponentUID(Components=beam_result_objects_2)  # -> UID; inputs Components: list; same code as componentuid
filter_2 = StreamFilter(Gate=smaller.SmallerThan, Stream0=np_column_viz_planes_2, Stream1=repo_column_grp_viz_planes_3)
item_13 = ListItem(List=flatten(filter_2), Index=0, Wrap=True)  # -> Item1, Item
len_2 = TextLength(Text=componentuid_5)
larger_8 = LargerThan(FirstNumber=len_2, SecondNumber="0")  # -> LargerThan, OrEqualTo
deplane = DeconstructPlane(Plane=item_13.Item1)  # -> Origin, XAxis, YAxis, ZAxis
deplane_2 = DeconstructPlane(Plane=item_13.Item)  # -> Origin, XAxis, YAxis, ZAxis
bunchmultiplier = Slider(2.5, range=0..10)
x_spacing_2 = Slider(1.5, range=0.1..3)
y_spacing_2 = Slider(1.5, range=0.1..3)
z_spacing = Slider(1.5, range=0.1..3)
beam_result_objects_3 = Data(beam_result_objects_2)
dispatch_pattern_reuse_np_4 = Data(larger_8.LargerThan)
dispatch_pattern_reuse_np_5 = Data(dispatch_pattern_reuse_np_4)
pdecon_3 = Deconstruct(Point=deplane.Origin)  # -> XComponent, YComponent, ZComponent
pdecon_4 = Deconstruct(Point=deplane_2.Origin)  # -> XComponent, YComponent, ZComponent
xz = XZPlane(Origin=Point(0, 0, 0))
pt_39 = ConstructPoint(XCoordinate=pdecon_3.XComponent, YCoordinate=pdecon_4.YComponent, ZCoordinate=pdecon_4.ZComponent)
dispatch_30 = Dispatch(List=beam_result_objects_3, DispatchPattern=dispatch_pattern_reuse_np_5)  # -> ListA, ListB
X_4 = UnitX(Factor=expr("x*4", x_spacing_2))
pl_origin = PlaneOrigin(Base=xz, Origin=pt_39)
beam_np_result_objects = Data(dispatch_30.ListB)
move_2 = Move(Geometry=pl_origin, Motion=X_4)  # -> Geometry, Transform
componentgroups_5 = Data(componentgroups_4)
groupcomponents_4 = GroupComponents(Components=beam_np_result_objects, Reverse=Toggle(True))  # -> ComponentGroups, IndexMap; inputs Components: list, Reverse: Boolean; same code as groupcomponents
componentgroups_6 = Data(componentgroups_4)
Z_3 = UnitZ(Factor=1)
pflip = FlipPlane(Plane=move_2.Geometry, ReverseX=False, ReverseY=False, SwapAxes=True)
componentboundingbox_7 = ComponentBoundingbox(Components=componentgroups_5)  # -> LEN, CSX, CSY; inputs Components: list; same code as componentboundingbox
componentuid_6 = ComponentUID(Components=componentgroups_5)  # -> UID; inputs Components: list; same code as componentuid
tstat_6 = TreeStatistics(Tree=componentgroups_6)  # -> Paths, Length, Count
align_2 = AlignPlane(Plane=pflip, Direction=Z_3)  # -> Plane, Angle
beam_result_objects_4 = Data(beam_result_objects_2)
python_3 = GhPythonScript(BP=align_2.Plane, N=tstat_6.Length, XS=x_spacing_2, ZS=z_spacing, BM=bunchmultiplier)  # -> PP; inputs BP: Plane, N: list of Int32
# ---------- python_3: Python ----------
__author__ = "EFESTWIN"
__version__ = "2023.01.06"

import Rhino
from ghpythonlib import treehelpers as th

def pyramid_rows(n):
    """
    Takes a number and returns a list of row numbers for a pyramid.
    """
    # utility functions
    def is_triangular(n):
        return (0.5 * ((8 * n + 1) ** 0.5 - 1)).is_integer()

    def first_row(n):
        i = 0
        t = 0
        b = None
        while i <= (n - t):
            t += i
            b = i
            i += 1
        return b

    def next_triangular(n):
        while is_triangular(n) == False:
            n += 1
        return n

    # check if n is triangular
    if is_triangular(n):
        fr = first_row(n)
    else:
        # find next larger triangular number
        tnext = next_triangular(n)
        fr = first_row(tnext)
    
    # create rows
    i = 0
    rows = []
    while i < n:
        row = 'x' * fr
        rows.append(row)
        fr -= 1
        i += len(row)
    
    # correct rows
    if i > n:
        s = i - n
        for j in range(s):
            if len(rows[-1]) > 0:
                rows[-1]
                rows[-1] = rows[-1][0:-1]
            else:
                rows.pop(-1)
                rows[-1]
                rows[-1] = rows[-1][0:-1]
    # verify
    outrows = [len(row) for row in rows]
    assert sum(outrows) == n
    return outrows

PP = []

base_plane = BP.Clone()

for k in range(len(N)):
    PR = pyramid_rows(N[k])
    
    vx = Rhino.Geometry.Vector3d.XAxis * XS
    vz = Rhino.Geometry.Vector3d.ZAxis * ZS
    
    p_planes = []
    for i, row in enumerate(PR):
        cpln = base_plane.Clone()
        cpln.Translate(vz * i)
        cpln.Translate(vx * i * 0.5)
        for j in range(row):
            rowpln = cpln.Clone()
            rowpln.Translate(vx * j)
            p_planes.append(rowpln)
    
    base_plane = p_planes[PR[0]-1].Clone()
    base_plane.Translate(vx * BM)
    
    PP.append(p_planes)

PP = th.list_to_tree(PP)
# ---------- end python_3 ----------
repo_beam_grp_uid = Data(componentuid_6)
repo_beam_grp_len = Number(componentboundingbox_7.LEN)
repo_beam_grp_csx = Number(componentboundingbox_7.CSX)
repo_beam_grp_csy = Number(componentboundingbox_7.CSY)
tstat_7 = TreeStatistics(Tree=groupcomponents_4.ComponentGroups)  # -> Paths, Length, Count
repo_beam_uid = Data(repo_beam_grp_uid)
dispatch_31 = Dispatch(List=componentuid_5, DispatchPattern=dispatch_pattern_reuse_np_4)  # -> ListA, ListB
componentboundingbox_8 = ComponentBoundingbox(Components=beam_result_objects_4)  # -> LEN, CSX, CSY; inputs Components: list; same code as componentboundingbox
deconstructresultobject_2 = DeconstructResultObject(ResultObject=beam_result_objects_4)  # -> idDemand, StockIndex, ReUse, Boundingbox, Volume, Utilization, Deconstruction, Demolition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; same code as deconstructresultobject
unflatten_3 = UnflattenTree(Tree=flatten(python_3), Guide=componentgroups_6)
dispatch_pattern_reuse_np_6 = Data(dispatch_pattern_reuse_np_4)
mindex_2 = MemberIndex(Set=flatten(repo_beam_uid), Member=dispatch_31.ListA)  # -> flatten(Index), Count
deplane_3 = DeconstructPlane(Plane=flatten(unflatten_3))  # -> Origin, XAxis, YAxis, ZAxis
pdecon_5 = Deconstruct(Point=deplane_3.Origin)  # -> XComponent, YComponent, ZComponent
repo_beam_grp_viz_planes = Data(unflatten_3)
repo_beam_grp_viz_planes_2 = Data(repo_beam_grp_viz_planes)
sort = SortList(Keys=pdecon_5.XComponent, ValuesB=flatten(unflatten_3))  # -> reverse(Keys), reverse(ValuesB)
item_14 = ListItem(List=flatten(repo_beam_uid), Index=mindex_2.Index, Wrap=True)
item_15 = ListItem(List=flatten(repo_beam_grp_viz_planes_2), Index=mindex_2.Index, Wrap=True)
dispatch_32 = Dispatch(List=componentboundingbox_8.LEN, DispatchPattern=dispatch_pattern_reuse_np_6)  # -> ListA, ListB
dispatch_33 = Dispatch(List=componentboundingbox_8.CSX, DispatchPattern=dispatch_pattern_reuse_np_6)  # -> ListA, ListB
dispatch_34 = Dispatch(List=componentboundingbox_8.CSY, DispatchPattern=dispatch_pattern_reuse_np_6)  # -> ListA, ListB
dispatch_35 = Dispatch(List=deconstructresultobject_2.idDemand, DispatchPattern=dispatch_pattern_reuse_np_6)  # -> ListA, ListB
dispatch_36 = Dispatch(List=deconstructresultobject_2.StockIndex, DispatchPattern=dispatch_pattern_reuse_np_6)  # -> ListA, ListB
vec = VectorXYZ(XComponent=expr("x*3", x_spacing_2), YComponent=0, ZComponent=0)  # -> Vector, Length
item_16 = ListItem(List=sort.ValuesB, Index=0, Wrap=True)
move_3 = Move(Geometry=item_16, Motion=vec.Vector)  # -> Geometry, Transform
python_4 = GhPythonScript(BP=move_3.Geometry, N=tstat_7.Length, XS=x_spacing_2, ZS=z_spacing, BM=bunchmultiplier)  # -> PP; inputs BP: Plane, N: list of Int32; same code as python_3
unflatten_4 = UnflattenTree(Tree=flatten(python_4), Guide=groupcomponents_4.ComponentGroups)  # -> flatten(Tree)
np_beam_viz_planes = Data(unflatten_4)
beam_reuse_demand_indices = Data(dispatch_35.ListA)
beam_repo_reuse_indices = Integer(dispatch_36.ListA)
beam_np_demand_indices = Data(dispatch_35.ListB)
beam_reuse_viz_planes = Data(item_15)
beam_reuse_csx = Data(dispatch_33.ListA)
beam_reuse_uids = Data(item_14)
beam_reuse_len = Data(dispatch_32.ListA)
beam_reuse_csy = Data(dispatch_34.ListA)
beam_np_csx = Data(dispatch_33.ListB)
beam_np_csy = Data(dispatch_34.ListB)
beam_np_len = Data(dispatch_32.ListB)

demand_geo_total_bbx_2 = Data(demand_geo_total_bbx)
debox_4 = DeconstructBox(Box=demand_geo_total_bbx_2)  # -> Plane, X, Y, Z
dedomain_10 = DeconstructDomain(Domain=debox_4.Y)  # -> Start, End
dedomain_11 = DeconstructDomain(Domain=debox_4.X)  # -> Start, End
dedomain_12 = DeconstructDomain(Domain=debox_4.Z)  # -> Start, End
dispatch_pattern_reuse_np_7 = Data(dispatch_pattern_reuse_np)
demand_slab_geo = Data(slab_geo_3)
demand_column_plane = Data(column_plane)
dispatch_pattern_reuse_np_8 = Data(dispatch_pattern_reuse_np_4)
spacing_factor = Slider(1.3, range=0..6)
demand_beam_plane = Data(beam_plane)
subtraction_9 = Subtraction(A=dedomain_10.End, B=dedomain_10.Start)
subtraction_10 = Subtraction(A=dedomain_11.End, B=dedomain_11.Start)
max_2 = Maximum(A=subtraction_10, B=subtraction_9)
pt_40 = ConstructPoint(XCoordinate=dedomain_11.Start, YCoordinate=dedomain_10.Start, ZCoordinate=dedomain_12.Start)
pt_41 = ConstructPoint(XCoordinate=dedomain_11.End, YCoordinate=dedomain_10.Start, ZCoordinate=dedomain_12.Start)
multiplication = Multiplication(A=max_2, B=spacing_factor)
X_5 = UnitX(Factor=multiplication)
move_4 = Move(Geometry=pt_41, Motion=X_5)  # -> Geometry, Transform
vec2pt_2 = Vector2Pt(PointA=pt_40, PointB=move_4.Geometry, Unitize=False)  # -> Vector, Length
move_5 = Move(Geometry=demand_slab_geo, Motion=vec2pt_2.Vector)  # -> Geometry, Transform
move_6 = Move(Geometry=demand_beam_plane, Motion=vec2pt_2.Vector)  # -> Geometry, Transform
move_7 = Move(Geometry=demand_column_plane, Motion=vec2pt_2.Vector)  # -> Geometry, Transform
dispatch_37 = Dispatch(List=move_6.Geometry, DispatchPattern=dispatch_pattern_reuse_np_8)  # -> ListA, ListB
dispatch_38 = Dispatch(List=move_7.Geometry, DispatchPattern=dispatch_pattern_reuse_np_7)  # -> ListA, ListB
beam_reuse_demand_planes = Data(dispatch_37.ListA)
column_reuse_demand_planes = Data(dispatch_38.ListA)
beam_np_demand_planes = Data(dispatch_37.ListB)
column_np_demand_planes = Data(dispatch_38.ListB)
demand_slab_geo_viz = Data(move_5.Geometry)

# ----
# comments & notes: BEAM NEW PRODUCTION VISUALISATION
# comments & notes: visualise new production members
beam_np_demand_indices_2 = Data(beam_np_demand_indices)
beam_np_demand_planes_2 = Data(beam_np_demand_planes)
renderrepository_2 = Boolean(renderrepository)
np_beam_viz_planes_2 = Data(np_beam_viz_planes)
beam_np_csy_2 = Data(beam_np_csy)
beam_np_len_2 = Data(beam_np_len)
beam_np_csx_2 = Data(beam_np_csx)
sort_2 = SortList(
    Keys=beam_np_len_2,
    ValuesA=beam_np_csx_2,
    ValuesB=beam_np_csy_2,
    ValuesC=beam_np_demand_indices_2,
    ValuesD=beam_np_demand_planes_2)  # -> reverse(Keys), reverse(ValuesA), reverse(ValuesB), reverse(ValuesC), reverse(ValuesD)
dom = ConstructDomain(DomainStart=expr("x*-0.5", sort_2.ValuesB), DomainEnd=expr("x*0.5", sort_2.ValuesB))
dom_2 = ConstructDomain(DomainStart=expr("x*-0.5", sort_2.ValuesA), DomainEnd=expr("x*0.5", sort_2.ValuesA))
dom_3 = ConstructDomain(DomainStart="0", DomainEnd=sort_2.Keys)
box = DomainBox(Base=np_beam_viz_planes_2, X=dom_2, Y=dom, Z=dom_3)
box_2 = DomainBox(Base=sort_2.ValuesD, X=dom_2, Y=dom, Z=dom_3)
rtd_6 = RoundToDecimal(Numbers=sort_2.Keys, DecimalPlaces="2")  # -> Rounded; inputs Numbers: list, DecimalPlaces: list of Int32; same code as rtd
rtd_7 = RoundToDecimal(Numbers=sort_2.ValuesA, DecimalPlaces="2")  # -> Rounded; inputs Numbers: list, DecimalPlaces: list of Int32; same code as rtd
rtd_8 = RoundToDecimal(Numbers=sort_2.ValuesB, DecimalPlaces="2")  # -> Rounded; inputs Numbers: list, DecimalPlaces: list of Int32; same code as rtd
filter_3 = StreamFilter(Gate=renderrepository_2, Stream1=box)
volume_3 = Volume(Geometry=filter_3)  # -> Volume, Centroid
volume_4 = Volume(Geometry=box_2)  # -> Volume, Centroid
merge_21 = Merge(Data1=filter_3, Data2=box_2)
X_6 = UnitX(Factor=expr("x*0.6", sort_2.ValuesA))
xz_2 = XZPlane(Origin=volume_4.Centroid)
xz_3 = XZPlane(Origin=volume_3.Centroid)
panel_11 = Panel("""[mN Beam]
i = {0}
L = {1}
CS = {2} x {3}""")
move_8 = Move(Geometry=xz_2, Motion=X_6)  # -> Geometry, Transform
move_9 = Move(Geometry=xz_3, Motion=X_6)  # -> Geometry, Transform
displaycurvecolor_2 = Data(displaycurvecolor)
viz_label_text_size_2 = Number(viz_label_text_size)
edges_2 = BrepEdges(Brep=merge_21)  # -> Naked, Interior, NonManifold
displaytextcolor_2 = Data(displaytextcolor)
format = Format(Format=panel_11, Culture=127, Data0=sort_2.ValuesC, Data1=rtd_6, Data2=rtd_7, Data3=rtd_8)
cpl_2 = CustomPreviewLineweights(Geometry=flatten([edges_2.Naked, edges_2.Interior, edges_2.NonManifold]), Color=displaycurvecolor_2)  # inputs Geometry: list, Color: Color; same code as cpl
preview_2 = CustomPreview(Geometry=merge_21, Material=ColourSwatch(SwatchColor=RGB(0, 204, 255)))
tag = TextTag3D(Location=move_9.Geometry, Text=format, Size=viz_label_text_size_2, Colour=displaytextcolor_2, Justification=7)
tag_2 = TextTag3D(Location=move_8.Geometry, Text=format, Size=viz_label_text_size_2, Colour=displaytextcolor_2, Justification=7)

# ----
# comments & notes: repository visualisation as greyed out translucent beams
renderrepository_3 = Boolean(renderrepository)
repo_beam_grp_viz_planes_3 = Data(repo_beam_grp_viz_planes)
repo_beam_grp_csy_2 = Number(repo_beam_grp_csy)
repo_beam_grp_len_2 = Number(repo_beam_grp_len)
repo_beam_grp_csx_2 = Number(repo_beam_grp_csx)
repo_beam_grp_uid_2 = Data(repo_beam_grp_uid)
dom_4 = ConstructDomain(DomainStart=expr("x*-0.499", repo_beam_grp_csx_2), DomainEnd=expr("x*0.499", repo_beam_grp_csx_2))
dom_5 = ConstructDomain(DomainStart=expr("x*-0.499", repo_beam_grp_csy_2), DomainEnd=expr("x*0.499", repo_beam_grp_csy_2))
dom_6 = ConstructDomain(DomainStart=0, DomainEnd=repo_beam_grp_len_2)
comments_notes_10 = Panel("BEAM REPOSITORY VISUALIZATION")
box_3 = DomainBox(Base=repo_beam_grp_viz_planes_3, X=dom_4, Y=dom_5, Z=dom_6)
xy_4 = XYPlane(Origin=Point(0, 0, 0))
sort_3 = SortList(Keys=flatten(repo_beam_grp_csx_2))  # -> reverse(Keys), ValuesA
pl_origin_2 = PlaneOrigin(Base=xy_4, Origin=repo_beam_grp_viz_planes_3)
filter_4 = StreamFilter(Gate=renderrepository_3, Stream1=box_3)
item_17 = ListItem(List=sort_3.Keys, Index=0, Wrap=True)
python_5 = GhPythonScript(UID=repo_beam_grp_uid_2)  # -> FormattedUID
# ---------- python_5: Python ----------
__author__ = "EFESTWIN"
__version__ = "2023.01.05"

import rhinoscriptsyntax as rs

suid = UID.split('-')
FormattedUID = (suid[0] + '\n' +
                suid[1] + '-' + suid[2] + '-' + suid[3] + '\n' +
                suid[4])
# ---------- end python_5 ----------
Y_5 = UnitY(Factor=expr("x*-0.1", item_17))
X_7 = UnitX(Factor=expr("x*-0.3", item_17))
panel_12 = Panel("""[R Beam]
uid = {0}
L = {1}
CS = {2} x {3}""")
preview_3 = CustomPreview(Geometry=filter_4, Material=ColourSwatch(SwatchColor=RGBA(168, 168, 168, 122)))
addition_5 = Addition(A=Y_5, B=X_7)
viz_label_text_size_3 = Number(viz_label_text_size)
displaytextcolor_3 = Data(displaytextcolor)
format_2 = Format(
    Format=panel_12,
    Culture=127,
    Data0=python_5,
    Data1=repo_beam_grp_len_2,
    Data2=repo_beam_grp_csx_2,
    Data3=repo_beam_grp_csy_2)
move_10 = Move(Geometry=pl_origin_2, Motion=addition_5)  # -> Geometry, Transform
filter_5 = StreamFilter(Gate=renderrepository_3, Stream1=move_10.Geometry)
tag_3 = TextTag3D(Location=filter_5, Text=format_2, Size=viz_label_text_size_3, Colour=displaytextcolor_3, Justification=4)

# ----
# comments & notes: visualise reused members in stock space
beam_reuse_demand_indices_2 = Data(beam_reuse_demand_indices)
beam_repo_reuse_indices_2 = Integer(beam_repo_reuse_indices)
beam_reuse_demand_planes_2 = Data(beam_reuse_demand_planes)
beam_reuse_viz_planes_2 = Data(beam_reuse_viz_planes)
renderrepository_4 = Boolean(renderrepository)
beam_reuse_uids_2 = Data(beam_reuse_uids)
beam_reuse_len_2 = Data(beam_reuse_len)
beam_reuse_csx_2 = Data(beam_reuse_csx)
beam_reuse_csy_2 = Data(beam_reuse_csy)
cutloss_2 = Number(cutloss)
python_6 = GhPythonScript(PLANES=beam_reuse_viz_planes_2, LENGTHS=beam_reuse_len_2, INDICES=beam_reuse_uids_2, CUTLOSS=cutloss_2)  # -> out, flatten(PLANES_OUT); inputs PLANES: list of Plane, LENGTHS: list, INDICES: list
# ---------- python_6: Python ----------
__author__ = "EFESTWIN"
__version__ = "2022.09.09"

import Rhino

idx_seen = set()
lng_map = {}

PLANES_OUT = []

for i in range(len(PLANES)):
    if INDICES[i] in idx_seen:
        print(INDICES[i])
        # find previous occurence
        v = PLANES[i].ZAxis * (lng_map[INDICES[i]] + CUTLOSS)
        newpln = PLANES[i].Clone()
        newpln.Translate(v)
        # add length to map
        lng_map[INDICES[i]] += LENGTHS[i] + CUTLOSS
        # append new plane to output
        PLANES_OUT.append(newpln)
    else:
        idx_seen.add(INDICES[i])
        lng_map[INDICES[i]] = LENGTHS[i]
        # append plane to output
        PLANES_OUT.append(PLANES[i])
# ---------- end python_6 ----------
dom_7 = ConstructDomain(DomainStart=expr("x*-0.5", beam_reuse_csy_2), DomainEnd=expr("x*0.5", beam_reuse_csy_2))
dom_8 = ConstructDomain(DomainStart=expr("x*-0.5", beam_reuse_csx_2), DomainEnd=expr("x*0.5", beam_reuse_csx_2))
dom_9 = ConstructDomain(DomainStart="0", DomainEnd=beam_reuse_len_2)
comments_notes_11 = Panel("BEAM REUSE VISUALISATION")
box_4 = DomainBox(Base=python_6.PLANES_OUT, X=dom_8, Y=dom_7, Z=dom_9)
box_5 = DomainBox(Base=beam_reuse_demand_planes_2, X=dom_8, Y=dom_7, Z=dom_9)
rtd_9 = RoundToDecimal(Numbers=beam_reuse_len_2, DecimalPlaces="2")  # -> Rounded; inputs Numbers: list, DecimalPlaces: list of Int32; same code as rtd
rtd_10 = RoundToDecimal(Numbers=beam_reuse_csx_2, DecimalPlaces="2")  # -> Rounded; inputs Numbers: list, DecimalPlaces: list of Int32; same code as rtd
rtd_11 = RoundToDecimal(Numbers=beam_reuse_csy_2, DecimalPlaces="2")  # -> Rounded; inputs Numbers: list, DecimalPlaces: list of Int32; same code as rtd
clean = CleanTree(RemoveNulls=True, RemoveInvalid=True, RemoveEmpty=True, Tree=beam_reuse_demand_indices_2)
clean_2 = CleanTree(RemoveNulls=True, RemoveInvalid=True, RemoveEmpty=True, Tree=beam_repo_reuse_indices_2)
filter_6 = StreamFilter(Gate=renderrepository_4, Stream1=box_4)
volume_5 = Volume(Geometry=filter_6)  # -> Volume, Centroid
volume_6 = Volume(Geometry=box_5)  # -> Volume, Centroid
merge_22 = Merge(Data1=filter_6, Data2=box_5)
panel_13 = Panel("""[mR Beam]
ij = {0}>{1}
L = {2}
CS = {3} x {4}""")
xz_4 = XZPlane(Origin=volume_5.Centroid)
X_8 = UnitX(Factor=expr("x*0.6", beam_reuse_csx_2))
xz_5 = XZPlane(Origin=volume_6.Centroid)
move_11 = Move(Geometry=xz_5, Motion=X_8)  # -> Geometry, Transform
move_12 = Move(Geometry=xz_4, Motion=X_8)  # -> Geometry, Transform
displaycurvecolor_3 = Data(displaycurvecolor)
edges_3 = BrepEdges(Brep=merge_22)  # -> Naked, Interior, NonManifold
viz_label_text_size_4 = Number(viz_label_text_size)
format_3 = Format(Format=panel_13, Culture=127, Data0=clean, Data1=clean_2, Data2=rtd_9, Data3=rtd_10, Data4=rtd_11)
displaytextcolor_4 = Data(displaytextcolor)
cpl_3 = CustomPreviewLineweights(Geometry=flatten([edges_3.Naked, edges_3.Interior, edges_3.NonManifold]), Color=displaycurvecolor_3)  # inputs Geometry: list, Color: Color; same code as cpl
preview_4 = CustomPreview(Geometry=merge_22, Material=ColourSwatch(SwatchColor=RGB(0, 217, 4)))
tag_4 = TextTag3D(Location=move_12.Geometry, Text=format_3, Size=viz_label_text_size_4, Colour=displaytextcolor_4, Justification=7)
tag_5 = TextTag3D(Location=move_11.Geometry, Text=format_3, Size=viz_label_text_size_4, Colour=displaytextcolor_4, Justification=7)

demand_slab_geo_viz_2 = Data(demand_slab_geo_viz)
comments_notes_12 = Panel("slab geo visualisation")
displaycurvecolor_4 = Data(displaycurvecolor)
edges_4 = BrepEdges(Brep=demand_slab_geo_viz_2)  # -> Naked, Interior, NonManifold
cpl_4 = CustomPreviewLineweights(Geometry=flatten([edges_4.Naked, edges_4.Interior, edges_4.NonManifold]), Color=displaycurvecolor_4)  # inputs Geometry: list, Color: Color; same code as cpl
preview_5 = CustomPreview(Geometry=demand_slab_geo_viz_2, Material=ColourSwatch(SwatchColor=RGB(255, 255, 255)))

# ----
# comments & notes: repository visualisation as greyed out translucent columns
repo_column_grp_viz_planes_4 = Data(repo_column_grp_viz_planes)
renderrepository_5 = Boolean(renderrepository)
repo_column_grp_csy_2 = Number(repo_column_grp_csy)
repo_column_uid_3 = Data(repo_column_uid)
repo_column_grp_len_2 = Number(repo_column_grp_len)
repo_column_grp_csx_2 = Number(repo_column_grp_csx)
dom_10 = ConstructDomain(DomainStart=expr("x*-0.499", repo_column_grp_csx_2), DomainEnd=expr("x*0.499", repo_column_grp_csx_2))
dom_11 = ConstructDomain(DomainStart=expr("x*-0.499", repo_column_grp_csy_2), DomainEnd=expr("x*0.499", repo_column_grp_csy_2))
dom_12 = ConstructDomain(DomainStart=0, DomainEnd=repo_column_grp_len_2)
comments_notes_13 = Panel("COLUMN REPOSITORY VISUALIZATION")
box_6 = DomainBox(Base=repo_column_grp_viz_planes_4, X=dom_10, Y=dom_11, Z=dom_12)
sort_4 = SortList(Keys=flatten(repo_column_grp_csx_2))  # -> reverse(Keys), ValuesA
item_18 = ListItem(List=sort_4.Keys, Index=0, Wrap=True)
python_7 = GhPythonScript(UID=repo_column_uid_3)  # -> FormattedUID; same code as python_5
panel_14 = Panel("""[R Column]
uid = {0}
L = {1}
CS = {2} x {3}""")
X_9 = UnitX(Factor=expr("x*-0.3", item_18))
Y_6 = UnitY(Factor=expr("x*-0.1", item_18))
filter_7 = StreamFilter(Gate=renderrepository_5, Stream1=box_6)
addition_6 = Addition(A=Y_6, B=X_9)
viz_label_text_size_5 = Number(viz_label_text_size)
displaytextcolor_5 = Data(displaytextcolor)
preview_6 = CustomPreview(Geometry=filter_7, Material=ColourSwatch(SwatchColor=RGBA(168, 168, 168, 122)))
format_4 = Format(
    Format=panel_14,
    Culture=127,
    Data0=python_7,
    Data1=repo_column_grp_len_2,
    Data2=repo_column_grp_csx_2,
    Data3=repo_column_grp_csy_2)
move_13 = Move(Geometry=repo_column_grp_viz_planes_4, Motion=addition_6)  # -> Geometry, Transform
filter_8 = StreamFilter(Gate=renderrepository_5, Stream1=move_13.Geometry)
tag_6 = TextTag3D(Location=filter_8, Text=format_4, Size=viz_label_text_size_5, Colour=displaytextcolor_5, Justification=4)

# ----
# comments & notes: HUD display of results
column_result_objects_5 = Data(column_result_objects)
displayresultshud_2 = Data(displayresultshud)
beam_result_objects_5 = Data(beam_result_objects)
charttextheight = Slider(12, range=0..100)
barheight = Slider(28, range=0..100)
padding = Slider(26, range=0..200)
border = Slider(0, range=0..8)
marginh = Slider(75, range=0..200)
marginv = Slider(40, range=0..200)
width = Slider(180, range=1..400)
drawpiecharts = BooleanToggle(False)
basecolor = ColourSwatch(SwatchColor=RGB(0, 130, 166))
displaytextcolor_6 = Data(displaytextcolor)
merge_23 = Merge(Data1=column_result_objects_5, Data2=beam_result_objects_5)  # -> flatten(Result)
filter_9 = StreamFilter(Gate=displayresultshud_2, Stream1=merge_23)
ft20hud = FT20HUD(
    ResultObjects=filter_9,
    MarginH=marginh,
    MarginV=marginv,
    Padding=padding,
    Width=width,
    DrawPieCharts=drawpiecharts,
    BarHeight=barheight,
    ChartTextHeight=charttextheight,
    Border=border,
    BaseColor=basecolor,
    LabelFont="Titillium Web",
    TextColor=displaytextcolor_6)  # inputs ResultObjects: list, MarginH: Int32, MarginV: Int32, Padding: Int32, Width: Int32, DrawPieCharts: Boolean, BarHeight: Int32, ChartTextHeight: Int32, Border: Int32, BaseColor: Color, DisplayGeo: list of Point3d
# ---------- ft20hud: Python ----------
# PYTHON STANDARD LIBRARY IMPORTS
from __future__ import division, print_function
import json
import math
import traceback

# GHPYTHON SDK IMPORTS
from ghpythonlib.componentbase import executingcomponent as component
import Grasshopper, GhPython
import System
import Rhino
import rhinoscriptsyntax as rs

# GHENV COMPONENT SETTINGS
ghenv.Component.Name = "FT20HUD"
ghenv.Component.NickName = "FT20HUD"
ghenv.Component.Category = "FERTIGTEIL2.0"
ghenv.Component.SubCategory = "03 Visualisation"

class FT20HUD(component):
    
    _is_bound = False
    
    def RunScript(self, ResultObjects, MarginH, MarginV, Padding, Width, DrawPieCharts, BarHeight, ChartTextHeight, Border, BaseColor, LabelFont, TextColor, DisplayGeo):
        
        if ResultObjects:
            # event handling
            if not self._is_bound:
                self.__enter__()
            
            # settings
            self.hmargin = MarginH
            self.vmargin = MarginV
            self.padding = Padding
            self.width = Width
            self.bar_height = BarHeight
            self.chart_text_height = ChartTextHeight
            self.border = Border
            self.font = LabelFont
            self.txtcolor = TextColor
            self.drawpie = DrawPieCharts
            
            # colors
            self.basecolor = BaseColor
            self.white = System.Drawing.Color.White
            self.black = System.Drawing.Color.Black
            self.blue = System.Drawing.Color.DeepSkyBlue
            self.green = System.Drawing.Color.Green
            self.gray = System.Drawing.Color.Gray
            
            # data
            self.result_objects = [json.loads(o) for o in ResultObjects]
            self.displaygeo = DisplayGeo
            
            # compute reuse rate
            reuse_count = [obj['reuse'] for obj in
                           self.result_objects].count(True)
            self.reuse_rate = reuse_count / len(self.result_objects)
            
            # compute impact pie chart pieces
            reuse_objs = [obj for obj in self.result_objects
                          if obj['reuse']]
            new_objs = [obj for obj in self.result_objects
                        if not obj['reuse']]
            
            re_imp_decon = 0
            re_imp_transport_lab = 0
            re_imp_fabrication = 0
            re_imp_transport_site = 0
            re_imp_assembly = 0
            
            rn_imp_demol = 0
            rn_imp_processing = 0
            rn_imp_rawmat_man = 0
            rn_imp_rawmat_trans = 0
            rn_imp_fabrication = 0
            rn_imp_transport_site = 0
            rn_imp_assembly = 0
            
            for i, obj in enumerate(reuse_objs):
                re_imp_decon += reuse_objs[i]['impacts']['demo_decon']
                re_imp_transport_lab += reuse_objs[i]['impacts']['transport_lab']
                re_imp_fabrication += reuse_objs[i]['impacts']['fabrication']
                re_imp_transport_site += reuse_objs[i]['impacts']['transport_site']
                re_imp_assembly += reuse_objs[i]['impacts']['assembly']
                
                rn_imp_demol += reuse_objs[i]['np_impacts']['demo_decon']
                rn_imp_processing += reuse_objs[i]['np_impacts']['processing']
                rn_imp_rawmat_man += reuse_objs[i]['np_impacts']['rawmat_man']
                rn_imp_rawmat_trans += reuse_objs[i]['np_impacts']['rawmat_trans']
                rn_imp_fabrication += reuse_objs[i]['np_impacts']['fabrication']
                rn_imp_transport_site += reuse_objs[i]['np_impacts']['transport_site']
                rn_imp_assembly += reuse_objs[i]['np_impacts']['assembly']
            
            self.re_imp_values = [re_imp_decon,
                                  re_imp_transport_lab,
                                  re_imp_fabrication,
                                  re_imp_transport_site,
                                  re_imp_assembly]
            
            self.re_imp_labels = ['Deconstruction: ' + self._num_to_lbl_co2e(re_imp_decon),
                                  'Transport to Lab: ' + self._num_to_lbl_co2e(re_imp_transport_lab),
                                  'Fabrication ' + self._num_to_lbl_co2e(re_imp_fabrication),
                                  'Transport to Site: ' + self._num_to_lbl_co2e(re_imp_transport_site),
                                  'Assembly: ' + self._num_to_lbl_co2e(re_imp_assembly)]
            
            np_imp_demol = 0
            np_imp_processing = 0
            np_imp_rawmat_man = 0
            np_imp_rawmat_trans = 0
            np_imp_fabrication = 0
            np_imp_transport_site = 0
            np_imp_assembly = 0
            
            for i, obj in enumerate(new_objs):
                np_imp_demol += new_objs[i]['impacts']['demo_decon']
                np_imp_processing += new_objs[i]['impacts']['processing']
                np_imp_rawmat_man += new_objs[i]['impacts']['rawmat_man']
                np_imp_rawmat_trans += new_objs[i]['impacts']['rawmat_trans']
                np_imp_fabrication += new_objs[i]['impacts']['fabrication']
                np_imp_transport_site += new_objs[i]['impacts']['transport_site']
                np_imp_assembly += new_objs[i]['impacts']['assembly']
            
            self.np_imp_values = [np_imp_demol,
                                  np_imp_processing,
                                  np_imp_rawmat_man,
                                  np_imp_rawmat_trans,
                                  np_imp_fabrication,
                                  np_imp_transport_site,
                                  np_imp_assembly]
            self.np_imp_labels = ['Demolition:' + self._num_to_lbl_co2e(np_imp_demol),
                                  'Processing: ' + self._num_to_lbl_co2e(np_imp_processing),
                                  'RawMat Manufacturing: ' + self._num_to_lbl_co2e(np_imp_rawmat_man),
                                  'RawMat Transport: ' + self._num_to_lbl_co2e(np_imp_rawmat_trans),
                                  'Fabrication: ' + self._num_to_lbl_co2e(np_imp_fabrication),
                                  'Transport to Site: ' + self._num_to_lbl_co2e(np_imp_transport_site),
                                  'Assembly: ' + self._num_to_lbl_co2e(np_imp_assembly)]
            
            self.comp_imp_values = [rn_imp_demol + np_imp_demol,
                                    rn_imp_processing + np_imp_processing,
                                    rn_imp_rawmat_man + np_imp_rawmat_man,
                                    rn_imp_rawmat_trans + np_imp_rawmat_trans,
                                    rn_imp_fabrication + np_imp_fabrication,
                                    rn_imp_transport_site + np_imp_transport_site,
                                    rn_imp_assembly + np_imp_assembly]
            self.comp_imp_labels = ['Demolition:' + self._num_to_lbl_co2e(self.comp_imp_values[0]),
                                    'Processing: ' + self._num_to_lbl_co2e(self.comp_imp_values[1]),
                                    'RawMat Manufacturing: ' + self._num_to_lbl_co2e(self.comp_imp_values[2]),
                                    'RawMat Transport: ' + self._num_to_lbl_co2e(self.comp_imp_values[3]),
                                    'Fabrication: ' + self._num_to_lbl_co2e(self.comp_imp_values[4]),
                                    'Transport to Site: ' + self._num_to_lbl_co2e(self.comp_imp_values[5]),
                                    'Assembly: ' + self._num_to_lbl_co2e(self.comp_imp_values[6])]
        else:
            self.__exit__()
    
    
    def DrawForeground(self, sender, arg):
        if self.drawingWires and self.result_objects:
            self.drawingWires = False
            try:
                if arg.Display.Viewport.Id == arg.RhinoDoc.Views.ActiveView.ActiveViewportID:
                    
                    # get world to screen and screen to world transform
                    # wcs = Rhino.DocObjects.CoordinateSystem.World
                    # scs = Rhino.DocObjects.CoordinateSystem.Screen
                    # xstw = arg.Display.Viewport.GetTransform(scs, wcs)
                    # xwts = arg.Display.Viewport.GetTransform(wcs, scs)
                    
                    # get camera and frustum plane (still needed??)
                    camerapln = arg.Display.Viewport.GetCameraFrame()[1]
                    frustumpln = arg.Display.Viewport.GetFrustumNearPlane()[1]
                    
                    # viewport properties
                    # vp_width = arg.Display.Viewport.Size.Width
                    # vp_height = arg.Display.Viewport.Size.Height
                    
                    far_corners = arg.Display.Viewport.GetFarRect()
                    near_corners = arg.Display.Viewport.GetNearRect()
                    view_corners = [
                        (far_corners[0] * 0.15 + near_corners[0] * 0.85),
                        (far_corners[1] * 0.15 + near_corners[1] * 0.85),
                        (far_corners[2] * 0.15 + near_corners[2] * 0.85)]
                    
                    view_width = view_corners[0].DistanceTo(view_corners[1])
                    view_height = view_corners[0].DistanceTo(view_corners[2])
                    
                    # contruct drawing plane
                    draw_plane = Rhino.Geometry.Plane(view_corners[0],
                                                      view_corners[1],
                                                      view_corners[2])
                    draw_plane.Translate(draw_plane.ZAxis * -0.1)
                    
                    # Colors
                    basecolor = self.basecolor
                    white = self.white
                    black = self.black
                    blue = self.blue
                    green = self.green
                    gray = self.gray
                    
                    # Margins & Padding
                    hmargin = self.hmargin
                    vmargin = self.vmargin
                    padding = self.padding
                    
                    # AnchorPt and Border
                    border = self.border
                    bar_height = self.bar_height
                    
                    # create initital anchorpt on top left with margins
                    anchor_pt = Rhino.Geometry.Point3d(hmargin, vmargin, 0)
                    
                    # REUSE RATE BAR -------------------------------------------
                    rr_bar_label = str(
                            round(self.reuse_rate * 100, 2)) + '% ReUse Rate'
                    self.DrawPercentageBar(anchor_pt,
                                           self.width, 
                                           bar_height,
                                           self.reuse_rate,
                                           rr_bar_label,
                                           basecolor,
                                           gray,
                                           border,
                                           self.font,
                                           arg)
                    
                    # SOLUTION IMPACT HEADING ----------------------------------
                    title_height = self.chart_text_height * 1.4
                    anchor_pt.X += self.width * 0.5
                    anchor_pt.Y += bar_height + padding + (title_height * 0.5)
                    anchor_pt_2d = Rhino.Geometry.Point2d(anchor_pt)
                    total_impact = sum(self.re_imp_values + self.np_imp_values)
                    total_impact_str = self._num_to_lbl_co2e(total_impact)
                    solution_label = 'Total Solution Impact: ' + total_impact_str
                    arg.Display.Draw2dText(solution_label,
                                           self.txtcolor,
                                           anchor_pt_2d,
                                           True,
                                           title_height,
                                           self.font)
                    
                    # REUSE IMPACT CHART ---------------------------------------
                    anchor_pt.X -= self.width * 0.5
                    anchor_pt.Y += padding + title_height
                    re_clabel_val = sum(self.re_imp_values)
                    re_clabel = self._num_to_lbl_co2e(re_clabel_val)
                    re_title = 'Partial ReUse Impact'
                    if self.drawpie:
                        self.DrawPieChart(anchor_pt,
                                          draw_plane,
                                          self.width,
                                          re_title,
                                          self.re_imp_values,
                                          self.re_imp_labels,
                                          re_clabel,
                                          basecolor,
                                          border,
                                          self.font,
                                          self.chart_text_height,
                                          arg)
                    else:
                        re_title += ': ' + re_clabel
                        self.DrawBarChart(anchor_pt,
                                          self.width,
                                          re_title,
                                          self.re_imp_values,
                                          self.re_imp_labels,
                                          bar_height,
                                          basecolor,
                                          border,
                                          self.font,
                                          self.chart_text_height,
                                          arg)
                        
                    # NEW PRODUCTION IMPACT CHART ------------------------------
                    if sum(self.np_imp_values) > 0:
                        np_clabel_val = sum(self.np_imp_values)
                        np_clabel = self._num_to_lbl_co2e(np_clabel_val)
                        np_title = 'Partial New Production Impact'
                        if self.drawpie:
                            anchor_pt.Y += (self.width +
                                            padding +
                                            (title_height * 1.2))
                            self.DrawPieChart(anchor_pt,
                                              draw_plane,
                                              self.width,
                                              np_title,
                                              self.np_imp_values,
                                              self.np_imp_labels,
                                              np_clabel,
                                              basecolor,
                                              border,
                                              self.font,
                                              self.chart_text_height,
                                              arg)
                        else:
                            np_title += ': ' + np_clabel
                            anchor_pt.Y += (title_height * 1.2 +
                                    (len(self.re_imp_values) * bar_height) +
                                    padding)
                            self.DrawBarChart(anchor_pt,
                                              self.width,
                                              np_title,
                                              self.np_imp_values,
                                              self.np_imp_labels,
                                              bar_height,
                                              basecolor,
                                              border,
                                              self.font,
                                              self.chart_text_height,
                                              arg)
                    
                    # DRAW COMPARED NEW PRODUCTION CHART -----------------------
                    comp_clabel_val = sum(self.comp_imp_values)
                    comp_clabel = self._num_to_lbl_co2e(comp_clabel_val)
                    comp_title = 'Est. Full New Production Impact'
                    if self.drawpie:
                        anchor_pt.Y += self.width + padding + title_height
                        self.DrawPieChart(anchor_pt,
                                          draw_plane,
                                          self.width,
                                          comp_title,
                                          self.comp_imp_values,
                                          self.comp_imp_labels,
                                          comp_clabel,
                                          basecolor,
                                          border,
                                          self.font,
                                          self.chart_text_height,
                                          arg)
                    else:
                        comp_title += ': ' + comp_clabel
                        if sum(self.np_imp_values) > 0:
                            anchor_pt.Y += (title_height * 1.2 +
                                        (len(self.np_imp_values) * bar_height) +
                                        padding)
                        else:
                            anchor_pt.Y += (title_height * 1.2 +
                                    (len(self.re_imp_values) * bar_height) +
                                    padding)
                        self.DrawBarChart(anchor_pt,
                                          self.width,
                                          comp_title,
                                          self.comp_imp_values,
                                          self.comp_imp_labels,
                                          bar_height,
                                          basecolor,
                                          border,
                                          self.font,
                                          self.chart_text_height,
                                          arg)
                    
                    # DRAW SAVINGS POTENTIAL -----------------------------------
                    if self.drawpie:
                        anchor_pt.Y += self.width + padding + title_height
                    else:
                        anchor_pt.Y += (title_height * 1.2 +
                                        (len(self.comp_imp_values) * bar_height) +
                                        padding)
                    savings = 1 - (total_impact / comp_clabel_val)
                    savings_label = str(round(savings * 100, 2)) + '% Savings'
                    self.DrawPercentageBar(anchor_pt,
                                           self.width, 
                                           bar_height,
                                           savings,
                                           savings_label,
                                           basecolor,
                                           gray,
                                           border,
                                           self.font,
                                           arg)
            
            except Exception as e:
                tb = traceback.format_exc()
                System.Windows.Forms.MessageBox.Show(
                                    tb,
                                    'Error while drawing preview!')
    
    
    def DrawPercentageBar(self, anchorpt, width, height, fill, label, col_a, col_b, border, font, arg):
        """
        Draw a percentage bar on the screen.
        """
        width_a = round(width * fill)
        width_b = width - width_a
        # compute rectangles
        # rec2d_bg = System.Drawing.Rectangle(anchorpt.X, anchorpt.Y, width,  height)
        rec2d_a = System.Drawing.Rectangle(anchorpt.X, anchorpt.Y, width_a, height)
        rec2d_b = System.Drawing.Rectangle(anchorpt.X + width_a, anchorpt.Y, width_b, height)
        
        # draw rectangles
        # arg.Display.Draw2dRectangle(rec2d_bg, System.Drawing.Color.Black, border, System.Drawing.Color.White)
        arg.Display.Draw2dRectangle(rec2d_b, System.Drawing.Color.Black, 0, col_b)
        arg.Display.Draw2dRectangle(rec2d_a, System.Drawing.Color.Black, border, col_a)
        
        txtpt = Rhino.Geometry.Point2d(anchorpt.X + (width / 2),
                                       anchorpt.Y + (height / 2))
        arg.Display.Draw2dText(label, self.txtcolor, txtpt, True, height / 2, font)
    
    
    def DrawPieChart(self, anchorpt, draw_plane, width, title, values, labels, centerlabel, color, border, font, txtheight, arg):
        """
        Draw a pie-chart on the screen.
        """
        # get scaling factor
        uppx = arg.Display.Viewport.GetWorldToScreenScale(anchorpt)[1]
        wcs = Rhino.DocObjects.CoordinateSystem.World
        scs = Rhino.DocObjects.CoordinateSystem.Screen
        xstw = arg.Display.Viewport.GetTransform(scs, wcs)
        xwts = arg.Display.Viewport.GetTransform(wcs, scs)
        
        # anchorpt is on top left, move it to center for heading text
        anchorpt = anchorpt.Clone()
        anchorpt.X += width * 0.5
        
        # create 2d anchorpt
        anchorpt_2d = Rhino.Geometry.Point2d(anchorpt)
        
        # draw heading
        title_height = txtheight * 1.4
        arg.Display.Draw2dText(title,
                               self.txtcolor,
                               anchorpt_2d,
                               True,
                               title_height,
                               self.font)
        
        anchorpt.Y += (title_height * 0.75) + (width * 0.5)
        anchorpt.Transform(xstw)
        
        # create circle plane
        circle_plane = draw_plane.Clone()
        circle_plane.Origin = anchorpt
        
        # get scaling factor
        uppx = arg.Display.Viewport.GetWorldToScreenScale(anchorpt)[1]
        
        # set radii
        outer_radius = (width * 0.45) / uppx
        inner_radius = outer_radius * 0.65
        label_radius = (width * 0.5) / uppx
        
        # create base circles
        inner_circle = Rhino.Geometry.Circle(circle_plane, inner_radius)
        outer_circle = Rhino.Geometry.Circle(circle_plane, outer_radius)
        label_circle = Rhino.Geometry.Circle(circle_plane, label_radius)
        
        # draw circles as borders
        if border > 1:
            arg.Display.DrawCircle(inner_circle, self.black, border - 1)
            arg.Display.DrawCircle(outer_circle, self.black, border - 1)
            # arg.Display.DrawCircle(label_circle, self.black, border - 1)
        
        # compute pie intervals
        pie_sum = sum(values)
        try:
            pie_percent = [v / pie_sum for v in values]
        except ZeroDivisionError:
            pie_percent = [1 for v in values]
        pie_pieces = []
        run_sum = 0
        for i in range(len(pie_percent)):
            rv = Rhino.Geometry.Interval(
                                run_sum * 2 * math.pi,
                                (run_sum + pie_percent[i]) * 2 * math.pi)
            pie_pieces.append(rv)
            run_sum += pie_percent[i]
        
        # create color palette
        colors = self.CreateColorPalette(color, range(len(values)))
        
        # loop over pie pieces
        for i in range(len(pie_pieces)):
            degr = (len(pie_pieces) / (2 * math.pi)) * 360
            div = round(max(degr, 1.0))
            
            # create outer arc and division points
            out_arc = Rhino.Geometry.Arc(outer_circle, pie_pieces[i])
            oac = out_arc.ToNurbsCurve()
            out_verts = [oac.PointAt(t) for t in oac.DivideByCount(div, True)]
            
            # create inner arc and division points
            in_arc = Rhino.Geometry.Arc(inner_circle, pie_pieces[i])
            iac = in_arc.ToNurbsCurve()
            in_verts = [iac.PointAt(t) for t in iac.DivideByCount(div, True)]
            
            # create empty mesh
            piece = Rhino.Geometry.Mesh()
            
            # add vertices and faces
            piece.Vertices.Add(in_verts[0] + (circle_plane.ZAxis * -0.0001))
            piece.Vertices.Add(out_verts[0] + (circle_plane.ZAxis  * -0.0001))
            v = 1
            for j in range(2, len(out_verts) * 2, 2):
                piece.Vertices.Add(in_verts[v]+(circle_plane.ZAxis * -0.0001))
                piece.Vertices.Add(out_verts[v]+(circle_plane.ZAxis * -0.0001))
                piece.Faces.AddFace(j - 2, j - 1, j + 1, j)
                v += 1
            piece.Compact()
            piece.RebuildNormals()
            
            # draw the pie piece mesh
            if colors[i].A < 255:
                mat = Rhino.Display.DisplayMaterial(
                                                colors[i],
                                                255 - (colors[i].A / 255.0))
                arg.Display.DrawMeshShaded(piece, mat)
            else:
                [piece.VertexColors.SetColor(j, colors[i])
                 for j in range(piece.Vertices.Count)]
                arg.Display.DrawMeshFalseColors(piece)
        
        # loop over pieces again and create labels
        for i in range(len(pie_pieces)):
            labelarc = Rhino.Geometry.Arc(label_circle, pie_pieces[i]).ToNurbsCurve()
            labelarc.Domain = Rhino.Geometry.Interval(0, 1)
            txtloc = labelarc.PointAt(0.5)
            
            anglex = (math.cos(pie_pieces[i].Mid) - 1.0) * 0.5
            angley = (math.sin(pie_pieces[i].Mid) - 1.0) * 0.5
            labellength = len(labels[i]) * (txtheight * 0.48)
            labelplane = circle_plane.Clone()
            labelplane.Origin = labelarc.PointAt(0.5) + (circle_plane.XAxis * (anglex * (labellength / uppx))) + (circle_plane.YAxis * (angley * (txtheight / uppx)))
            tha = Rhino.DocObjects.TextHorizontalAlignment.Left
            tva = Rhino.DocObjects.TextVerticalAlignment.Middle
            arg.Display.Draw3dText(
                                labels[i],
                                self.txtcolor, 
                                labelplane,
                                (txtheight / uppx) * 0.7,
                                font,
                                False,
                                False,
                                Rhino.DocObjects.TextHorizontalAlignment.Left,
                                Rhino.DocObjects.TextVerticalAlignment.Middle)
        # draw center label
        arg.Display.Draw3dText(centerlabel,
                               self.txtcolor, 
                               circle_plane,
                               (txtheight / uppx) * 0.7,
                               font,
                               True,
                               False,
                               Rhino.DocObjects.TextHorizontalAlignment.Center,
                               Rhino.DocObjects.TextVerticalAlignment.Middle)
    
    
    def DrawBarChart(self, anchorpt, width, title, values, labels, barheight, color, border, font, txtheight, arg):
        """
        Draw a Bar Chart on the screen.
        """
        # get scaling factor
        uppx = arg.Display.Viewport.GetWorldToScreenScale(anchorpt)[1]
        wcs = Rhino.DocObjects.CoordinateSystem.World
        scs = Rhino.DocObjects.CoordinateSystem.Screen
        xstw = arg.Display.Viewport.GetTransform(scs, wcs)
        xwts = arg.Display.Viewport.GetTransform(wcs, scs)
        
        # create color palette
        colors = self.CreateColorPalette(color, range(len(values)))
        
        # anchorpt is on top left, move it to center for heading text
        anchorpt = anchorpt.Clone()
        anchorpt.X += width * 0.5
        
        # create 2d anchorpt
        anchorpt_2d = Rhino.Geometry.Point2d(anchorpt)
        
        # draw heading
        title_height = txtheight * 1.4
        arg.Display.Draw2dText(title,
                               self.txtcolor,
                               anchorpt_2d,
                               True,
                               title_height,
                               self.font)
        anchorpt.X -= width * 0.5
        anchorpt.Y += title_height * 0.7
        
        linmin = 0
        linmax = sum(values)
        logmin = 1
        logmax = sum(values)
        for i, val in enumerate(values):
            try:
                linval = ((val - linmin) / (linmax - linmin))
                logval = ((math.log(val) - math.log(logmin)) / (math.log(logmax) - math.log(logmin)))
            except ZeroDivisionError:
                linval = 0
                logval = 0
            barwidth = max(1, linval * width)
            rec = System.Drawing.Rectangle(anchorpt.X,
                                           anchorpt.Y,
                                           barwidth,
                                           barheight)
            arg.Display.Draw2dRectangle(rec,
                                        System.Drawing.Color.Black,
                                        0,
                                        colors[i])
            txtpt = Rhino.Geometry.Point2d(anchorpt.X + barwidth + 2,
                                           anchorpt.Y + (barheight / 2.5))
            arg.Display.Draw2dText(labels[i],
                                   self.txtcolor,
                                   txtpt,
                                   False,
                                   txtheight,
                                   font)
            anchorpt.Y += barheight
    
    
    def CreateColorPalette(self, basecolor, values, srcMin = None, srcMax = None, targetMin = 0.4, targetMax = 0.99):
        """
        Create a Palette of colours based on a basecolor.
        """
        srcval = sorted(values)
        if srcMin == None:
            srcMin = srcval[0]
        if srcMax == None:
            srcMax = srcval[-1]
        
        remappedValues = []
        for v in values:
            if srcMax - srcMin > 0:
                rv = ((v - srcMin) / (srcMax - srcMin)) * (targetMax - targetMin) + targetMin
            else:
                rv = (targetMin + targetMax) / 2
            remappedValues.append(rv)
    
        # Make colors and return
        colors = []
        for v in remappedValues:
            hsvcol = Rhino.Display.ColorHSV(basecolor)
            c = Rhino.Display.ColorHSV(hsvcol.H, 1.0 - v, v).ToArgbColor()
            colors.append(c)
    
        return colors
    
    
    def _num_to_lbl_co2e(self, v):
        if v > 1000:
            return str(round(v / 1000, 2)) + ' t CO²e'
        else:
            return str(round(v, 2)) + ' kg CO²e'
    
    
    def DrawViewportWires(self, arg):
        self.drawingWires = True
    
    
    def __exit__(self):
        Rhino.Display.DisplayPipeline.DrawForeground -= self.DrawForeground
        self._is_bound = False
    
    
    def __enter__(self):
        Rhino.Display.DisplayPipeline.DrawForeground += self.DrawForeground
        self._is_bound = True
# ---------- end ft20hud ----------

# ----
# comments & notes: visualise reused members in stock space
column_reuse_demand_indices_2 = Data(column_reuse_demand_indices)
column_reuse_demand_planes_2 = Data(column_reuse_demand_planes)
column_reuse_len_2 = Data(column_reuse_len)
column_reuse_csx_2 = Data(column_reuse_csx)
column_reuse_csy_2 = Data(column_reuse_csy)
column_reuse_indices = Integer(column_repo_reuse_indices)
column_reuse_uids_2 = Data(column_reuse_uids)
renderrepository_6 = Boolean(renderrepository)
column_reuse_viz_planes_2 = Data(column_reuse_viz_planes)
cutloss_3 = Number(cutloss)
python_8 = GhPythonScript(PLANES=column_reuse_viz_planes_2, LENGTHS=column_reuse_len_2, INDICES=column_reuse_uids_2, CUTLOSS=cutloss_3)  # -> out, flatten(PLANES_OUT); inputs PLANES: list of Plane, LENGTHS: list, INDICES: list; same code as python_6
dom_13 = ConstructDomain(DomainStart=expr("x*-0.5", column_reuse_csy_2), DomainEnd=expr("x*0.5", column_reuse_csy_2))
dom_14 = ConstructDomain(DomainStart=expr("x*-0.5", column_reuse_csx_2), DomainEnd=expr("x*0.5", column_reuse_csx_2))
comments_notes_14 = Panel("COLUMN REUSE VISUALISATION")
dom_15 = ConstructDomain(DomainStart="0", DomainEnd=column_reuse_len_2)
box_7 = DomainBox(Base=python_8.PLANES_OUT, X=dom_14, Y=dom_13, Z=dom_15)
box_8 = DomainBox(Base=column_reuse_demand_planes_2, X=dom_14, Y=dom_13, Z=dom_15)
rtd_12 = RoundToDecimal(Numbers=column_reuse_len_2, DecimalPlaces="2")  # -> Rounded; inputs Numbers: list, DecimalPlaces: list of Int32; same code as rtd
rtd_13 = RoundToDecimal(Numbers=column_reuse_csx_2, DecimalPlaces="2")  # -> Rounded; inputs Numbers: list, DecimalPlaces: list of Int32; same code as rtd
rtd_14 = RoundToDecimal(Numbers=column_reuse_csy_2, DecimalPlaces="2")  # -> Rounded; inputs Numbers: list, DecimalPlaces: list of Int32; same code as rtd
clean_3 = CleanTree(RemoveNulls=True, RemoveInvalid=True, RemoveEmpty=True, Tree=column_reuse_indices)
clean_4 = CleanTree(RemoveNulls=True, RemoveInvalid=True, RemoveEmpty=True, Tree=column_reuse_demand_indices_2)
filter_10 = StreamFilter(Gate=renderrepository_6, Stream1=box_7)
volume_7 = Volume(Geometry=box_8)  # -> Volume, Centroid
volume_8 = Volume(Geometry=filter_10)  # -> Volume, Centroid
merge_24 = Merge(Data1=filter_10, Data2=box_8)
panel_15 = Panel("""[mR Column]
ij = {0}>{1}
L = {2}
CS = {3} x {4}""")
X_10 = UnitX(Factor=expr("x*0.6", column_reuse_csx_2))
xz_6 = XZPlane(Origin=volume_7.Centroid)
xz_7 = XZPlane(Origin=volume_8.Centroid)
displaycurvecolor_5 = Data(displaycurvecolor)
move_14 = Move(Geometry=xz_6, Motion=X_10)  # -> Geometry, Transform
move_15 = Move(Geometry=xz_7, Motion=X_10)  # -> Geometry, Transform
edges_5 = BrepEdges(Brep=merge_24)  # -> Naked, Interior, NonManifold
viz_label_text_size_6 = Number(viz_label_text_size)
displaytextcolor_7 = Data(displaytextcolor)
format_5 = Format(Format=panel_15, Culture=127, Data0=clean_4, Data1=clean_3, Data2=rtd_12, Data3=rtd_13, Data4=rtd_14)
cpl_5 = CustomPreviewLineweights(Geometry=flatten([edges_5.Naked, edges_5.Interior, edges_5.NonManifold]), Color=displaycurvecolor_5)  # inputs Geometry: list, Color: Color; same code as cpl
preview_7 = CustomPreview(Geometry=merge_24, Material=ColourSwatch(SwatchColor=RGB(0, 217, 4)))
tag_7 = TextTag3D(Location=move_15.Geometry, Text=format_5, Size=viz_label_text_size_6, Colour=displaytextcolor_7, Justification=7)
tag_8 = TextTag3D(Location=move_14.Geometry, Text=format_5, Size=viz_label_text_size_6, Colour=displaytextcolor_7, Justification=7)

# ----
# comments & notes: COLUMN NEW PRODUCTION VISUALISATION
# comments & notes: visualise new production members
np_column_viz_planes_3 = Data(np_column_viz_planes)
column_np_len_2 = Data(column_np_len)
column_np_csx_2 = Data(column_np_csx)
column_np_csy_2 = Data(column_np_csy)
renderrepository_7 = Boolean(renderrepository)
column_np_demand_indices_2 = Data(column_np_demand_indices)
column_np_demand_planes_2 = Data(column_np_demand_planes)
dom_16 = ConstructDomain(DomainStart=expr("x*-0.5", column_np_csy_2), DomainEnd=expr("x*0.5", column_np_csy_2))
dom_17 = ConstructDomain(DomainStart=expr("x*-0.5", column_np_csx_2), DomainEnd=expr("x*0.5", column_np_csx_2))
dom_18 = ConstructDomain(DomainStart="0", DomainEnd=column_np_len_2)
box_9 = DomainBox(Base=np_column_viz_planes_3, X=dom_17, Y=dom_16, Z=dom_18)
box_10 = DomainBox(Base=column_np_demand_planes_2, X=dom_17, Y=dom_16, Z=dom_18)
rtd_15 = RoundToDecimal(Numbers=column_np_len_2, DecimalPlaces="2")  # -> Rounded; inputs Numbers: list, DecimalPlaces: list of Int32; same code as rtd
rtd_16 = RoundToDecimal(Numbers=column_np_csx_2, DecimalPlaces="2")  # -> Rounded; inputs Numbers: list, DecimalPlaces: list of Int32; same code as rtd
rtd_17 = RoundToDecimal(Numbers=column_np_csy_2, DecimalPlaces="2")  # -> Rounded; inputs Numbers: list, DecimalPlaces: list of Int32; same code as rtd
filter_11 = StreamFilter(Gate=renderrepository_7, Stream1=box_9)
volume_9 = Volume(Geometry=filter_11)  # -> Volume, Centroid
volume_10 = Volume(Geometry=box_10)  # -> Volume, Centroid
merge_25 = Merge(Data1=filter_11, Data2=box_10)
X_11 = UnitX(Factor=expr("x*0.6", column_np_csx_2))
xz_8 = XZPlane(Origin=volume_10.Centroid)
xz_9 = XZPlane(Origin=volume_9.Centroid)
panel_16 = Panel("""[mN Column]
i = {0}
L = {1}
CS = {2} x {3}""")
move_16 = Move(Geometry=xz_8, Motion=X_11)  # -> Geometry, Transform
move_17 = Move(Geometry=xz_9, Motion=X_11)  # -> Geometry, Transform
viz_label_text_size_7 = Number(viz_label_text_size)
edges_6 = BrepEdges(Brep=merge_25)  # -> Naked, Interior, NonManifold
displaycurvecolor_6 = Data(displaycurvecolor)
displaytextcolor_8 = Data(displaytextcolor)
format_6 = Format(Format=panel_16, Culture=127, Data0=column_np_demand_indices_2, Data1=rtd_15, Data2=rtd_16, Data3=rtd_17)
cpl_6 = CustomPreviewLineweights(Geometry=flatten([edges_6.Naked, edges_6.Interior, edges_6.NonManifold]), Color=displaycurvecolor_6)  # inputs Geometry: list, Color: Color; same code as cpl
preview_8 = CustomPreview(Geometry=merge_25, Material=ColourSwatch(SwatchColor=RGB(0, 204, 255)))
tag_9 = TextTag3D(Location=move_17.Geometry, Text=format_6, Size=viz_label_text_size_7, Colour=displaytextcolor_8, Justification=7)
tag_10 = TextTag3D(Location=move_16.Geometry, Text=format_6, Size=viz_label_text_size_7, Colour=displaytextcolor_8, Justification=7)
